# Grasshopper definition Part_01_K.gh (Grasshopper 1.0.5)
# Copyright: Co-de-iT
# plug-ins: MeshEdit Components, Human, Weaverbird, Kangaroo2 Components

# ---- group: extra springs
crv = Curve([<curve referenced from the Rhino model> x3])

# ---- group: anchor curves
crv_2 = Curve([<curve referenced from the Rhino model> x3])

# ---- group: low-poly mesh
mesh = Mesh([<mesh referenced from the Rhino model> x3])

# ----
subdivision = Slider(2, range=1..3)
wbjoin = WeaverbirdsJoinMeshesAndWeld(Mesh=mesh, Weld=True)
wbcatmullclark = WeaverbirdsCatmullClarkSubdivision(MeshCurves=wbjoin, Level=subdivision, SmoothNakedEdges=2)
end = EndPoints(Curve=crv)  # -> Start, End
md = MeshDirection(Mesh=wbcatmullclark)
f_submqf = SubdivideMeshQuadFace(mesh=md, u_steps=Slider(2, range=1..10), v_steps=Slider(1, range=1..10))  # -> point_grid, mesh_2
nv = NakedVertices(Mesh=f_submqf.mesh_2)  # -> ClothedIndex, NakedIndex, ClothedPts, NakedPts
nakededge = MeshNakedEdge(Mesh=f_submqf.mesh_2)  # -> V, A, B
pdecon = Deconstruct(Point=nv.NakedPts)  # -> XComponent, YComponent, ZComponent
item = ListItem(List=nakededge.V, Index=nakededge.B, Wrap=True)
item_2 = ListItem(List=nakededge.V, Index=nakededge.A, Wrap=True)
cp = ClosestPoint(Point=end.Start, Cloud=nv.NakedPts)  # -> ClosestPoint, CPIndex, Distance
# Kangaroo Simulation setup
# 
# from basic low-poly mesh to simulated material properties
# 
# code by Alessio Erioli
# 
# v 1.0
# 
# © Co-de-iT 2018 _ Creative Commons Attribution-NonCommercial-ShareAlike 4.0 International License
wbjoin_2 = WeaverbirdsJoinMeshesAndWeld(Mesh=f_submqf.mesh_2, Weld=False)
ln = Line(StartPoint=item_2, EndPoint=item)
equals = Equality(FirstNumber=pdecon.ZComponent, SecondNumber="0.0")  # -> Equality, Inequality
curvepoint = PointOnCurve(ln, parameter=0.5)
warpweft = WarpWeft(Mesh=wbjoin_2)  # -> Warp, Weft, NakedA, NakedB
dispatch = Dispatch(List=nv.NakedPts, DispatchPattern=equals.Equality)  # -> ListA, ListB
ln_2 = Line(StartPoint=cp.ClosestPoint, EndPoint=end.End)
ln_3 = Line(StartPoint=cp.ClosestPoint, EndPoint=end.Start)
pt = Point(dispatch.ListA)
pdecon_2 = Deconstruct(Point=curvepoint)  # -> XComponent, YComponent, ZComponent
lng = ListLength(List=crv_2)

# ---- group: Weft
crv_3 = Curve(warpweft.Weft)

# ---- group: Warp
crv_4 = Curve(warpweft.Warp)

# ----
crv_cp = CurveClosestPoint(Point=graft(pt), Curve=crv_2)  # -> Point, Parameter, Distance
equals_2 = Equality(FirstNumber=pdecon_2.ZComponent, SecondNumber="0")  # -> Equality, Inequality
previewlw = CustomPreviewLineweights(Geometry=[ln_2, ln_3], Shader=ColourSwatch(SwatchColor=RGB(36, 244, 255)), Thickness="3", Absolute=False)
series = Series(Start=0, Step=1, Count=lng)
dispatch_2 = Dispatch(List=ln, DispatchPattern=equals_2.Equality)  # -> ListA, ListB

rest_length = Slider(1, range=0..2)

rest_length_2 = Slider(1, range=0..2)

rest_angle = Slider(0, range=0..1)

rest_angle_2 = Slider(0, range=0..1)

rest_length_3 = Slider(0.7, range=0..2)

rest_length_4 = Slider(1, range=0..2)
target_curve_strength = Slider(2000, range=1..2000)
gravity_factor = Slider(0.4, range=0..1)
sort = SortList(Keys=crv_cp.Distance, ValuesA=series)  # -> Keys, ValuesA
join = JoinCurves(Curves=dispatch_2.ListB, Preserve=False)
item_3 = ListItem(List=sort.ValuesA, Index=0, Wrap=True)  # -> flatten(Item)
join_2 = JoinCurves(Curves=crv_3, Preserve=False)
explode = Explode(Curve=join, Recursive=True)  # -> Segments, Vertices
mindex = MemberIndex(Set=item_3, Member=graft(series))  # -> Index, Count
explode_2 = Explode(Curve=join_2, Recursive=True)  # -> Segments, Vertices
end_2 = EndPoints(Curve=crv_2)  # -> Start, End
len = Length(Curve=crv_4)
len_2 = Length(Curve=crv_3)
len_3 = Length(Curve=ln_3)
len_4 = Length(Curve=ln_2)
pi = Pi(Factor=rest_angle)
f_dbshift = DoubleShift(L=explode_2.Segments, W=Toggle(False))  # -> Fw, Bw; inputs L: list, W: Boolean
# ---------- f_dbshift: C# ----------
                                        /*
    froGH - a sparse collection of (in)utilities for Grasshopper

    Double Shift
    code by Alessio Erioli

    froGH by Co-de-iT is licensed under a Creative Commons Attribution 4.0 International License.
    http://creativecommons.org/licenses/by/4.0/

    */

    initComp();

    if (L.Count > 0){

      List<object> fW = new List<object>(L);
      List<object> bW = new List<object>(L);


      fW.RemoveAt(L.Count - 1);
      bW.RemoveAt(0);

      if (W){
        fW.Insert(0, L[L.Count - 1]);
        bW.Add(L[0]);
      }

      Fw = fW;
      Bw = bW;
    }
# ---------- f_dbshift: C# additional code ----------
  void initComp(){
    Component.Name = "Double Shift";
    Component.NickName = "f_DbShift";
    Component.Description = "Performs a double shift on a list - with optional wrap";

    Component.Params.Input[0].Name = "List";
    Component.Params.Input[0].Description = "List to shift";
    Component.Params.Input[1].Name = "Wrap";
    Component.Params.Input[1].Description = "enable-disable wrap behavior";
    Component.Params.Output[0].Name = "Forward";
    Component.Params.Output[0].Description = "forward-shifted list";
    Component.Params.Output[1].Name = "Backward";
    Component.Params.Output[1].Description = "backward-shifted list";
  }
# ---------- end f_dbshift ----------
item_4 = ListItem(List=pt, Index=mindex.Index, Wrap=True)
shift = ShiftList(List=explode.Segments, Shift=1, Wrap=True)
merge = Merge(Data1=end.Start, Data2=end_2.Start, Data3=end_2.End, Data4=end.End)
multiplication = Multiplication(A=len_3, B=rest_length_3)
multiplication_2 = Multiplication(A=len_4, B=rest_length_4)
multiplication_3 = Multiplication(A=len_2, B=rest_length_2)
multiplication_4 = Multiplication(A=len, B=rest_length)
pi_2 = Pi(Factor=rest_angle_2)
Z = UnitZ(Factor=gravity_factor)

# ---- group: anchor curves
oncurve = OnCurve(Points=item_4, Curve=graft(crv_2), Strength=target_curve_strength)

# ---- group: weft curves
angle = Angle(LineA=f_dbshift.Fw, LineB=f_dbshift.Bw, RestAngle=pi, Strength=Slider(100, range=0..100))
length_line = LengthLine(Line=crv_3, Length=multiplication_3, Strength=Slider(17.6, range=0..100))

# ---- group: non-anchored naked edges
angle_2 = Angle(LineA=explode.Segments, LineB=shift, RestAngle=pi_2, Strength=Slider(2000, range=1..2000))

# ---- group: anchor points
anchor = Anchor(Point=merge, Strength=10000)

# ---- group: warp curves
length_line_2 = LengthLine(Line=crv_4, Length=multiplication_4, Strength=Slider(100, range=0..100))

# ---- group: extra springs
length_line_3 = LengthLine(Line=ln_3, Length=multiplication, Strength=Slider(703, range=10..1000))
length_line_4 = LengthLine(Line=ln_2, Length=multiplication_2, Strength=Slider(1000, range=10..1000))

# ---- group: gravity load
load = Load(Point=nv.ClothedPts, ForceVector=Z)

# ---- group: geometry
show = Show(G=f_submqf.mesh_2)

# ----
entwine = Entwine(
    Branch00=show,
    Branch01=length_line_2,
    Branch02=length_line,
    Branch03=angle,
    Branch04=angle_2,
    Branch05=length_line_3,
    Branch06=length_line_4,
    Branch07=load,
    Branch08=anchor,
    Branch09=oncurve,
    FlattenInputs=True)

reset = Button()
activate = BooleanToggle(False)

solver = Solver(GoalObjects=entwine, Reset=reset, Threshold=1e-15, Tolerance=0.01, On=activate)  # -> I, V, O
bang = ExplodeTree(Data=solver.O)  # -> Branch0, Branch1, Branch2
mesh_2 = Mesh(bang.Branch0)
wbjoin_3 = WeaverbirdsJoinMeshesAndWeld(Mesh=mesh_2, Weld=True)
crv_5 = Curve(bang.Branch2)
crv_6 = Curve(bang.Branch1)
wbcatmullclark_2 = WeaverbirdsCatmullClarkSubdivision(MeshCurves=wbjoin_3, Level=1, SmoothNakedEdges=1)
gate = StreamGate(Stream=wbcatmullclark_2, Gate=activate)  # -> Target0, Target1
previewmat = CustomPreviewMaterials(Geometry=wbcatmullclark_2, DiffuseColor=RGB(255, 255, 255))
md_2 = MeshDirection(Mesh=gate.Target0)
scale = Scale(Geometry=md_2, Center=Point(0, 0, 0), Factor="0.05")  # -> Geometry, Transform

# ---- group: bake this for Millipede
mesh_3 = Mesh(scale.Geometry)

# ==== cluster SubdivideMeshQuadFace: Subdivides a mesh face in a custom UV number of sub-faces
mesh = ClusterInput()  # Mesh Quad face(s) to subdivide
v_steps = ClusterInput()  # number of steps in V direction
u_steps = ClusterInput()  # number of steps in U direction
wbjoin = WeaverbirdsJoinMeshesAndWeld(Mesh=mesh, Weld=True)
explode = MeshExplode(Mesh=wbjoin, Interpolate=False)  # -> graft(Faces)
lng = ListLength(List=flatten(explode))
equals = Equality(FirstNumber=lng, SecondNumber=1)  # -> Equality, Inequality
demesh = DeconstructMesh(Mesh=explode)  # -> Vertices, Faces, Colours, Normals
item = ListItem(List=demesh.Vertices, Index=0, Wrap=True)  # -> Item, Item1, Item2, Item3
# froGH - a sparse collection of (in)utilities for Grasshopper
# 
#     froGH by Co-de-iT is licensed under a Creative Commons Attribution 4.0 International License.
#     http://creativecommons.org/licenses/by/4.0/
range = Range(Domain=Domain(0, 1), Steps=v_steps)
range_2 = Range(Domain=Domain(0, 1), Steps=u_steps)
merge = Merge(Data1=graft(item.Item), Data2=graft(item.Item1))  # -> simplify(Result)
merge_2 = Merge(Data1=graft(item.Item3), Data2=graft(item.Item2))  # -> simplify(Result)
interp = InterpolateData(Data=merge, Parameter=range_2, Interpolation=2)
interp_2 = InterpolateData(Data=merge_2, Parameter=range_2, Interpolation=2)
merge_3 = Merge(Data1=graft(interp), Data2=graft(interp_2))  # -> simplify(Result)
interp_3 = InterpolateData(Data=merge_3, Parameter=range, Interpolation=2)
match = MatchTree(Tree=interp_3, Guide=merge_3)
pshift = ShiftPaths(Data=match, Offset=-1)
filter = StreamFilter(Gate=equals.Equality, Stream0=pshift, Stream1=flatten(interp_3))
frompoints = MeshFromPoints(Points=filter, UDirection=expr("x+1", u_steps), VDirection=expr("x+1", v_steps))
wbjoin_2 = WeaverbirdsJoinMeshesAndWeld(Mesh=flatten(frompoints), Weld=True)
point_grid = ClusterOutput(filter)  # The grid of subdivided vertices
mesh_2 = ClusterOutput(wbjoin_2)  # The subdivided Mesh
