# Grasshopper definition Part_01_K_simplified.gh (Grasshopper 1.0.5)
# Copyright: Co-de-iT
# plug-ins: MeshEdit Components, Weaverbird, Kangaroo2 Components

mesh = Mesh(<mesh referenced from the Rhino model>)
weldvertices = MeshWeldVertices(Mesh=mesh, Tolerance=0.01)  # -> RuntimeMessage, Mesh
wbcatmullclark = WeaverbirdsCatmullClarkSubdivision(MeshCurves=weldvertices.Mesh, Level="2", SmoothNakedEdges=1)
anchor_naked_point_threshold = Slider(0.136, range=0..1)
nv = NakedVertices(Mesh=wbcatmullclark)  # -> ClothedIndex, NakedIndex, ClothedPts, NakedPts
medges = MeshEdges(Mesh=wbcatmullclark)  # -> NakedEdges, InteriorEdges, NonManifoldEdges

# ---- group: rim elastic bending (not so good as effect)
join = JoinCurves(Curves=medges.NakedEdges, Preserve=False)
item = ListItem(List=join, Index=0, Wrap=True)
explode = Explode(Curve=item, Recursive=True)  # -> Segments, Vertices
shift = ShiftList(List=explode.Segments, Shift=1, Wrap=True)
angle = Angle(LineA=explode.Segments, LineB=shift, RestAngle=Slider(0, range=0..1), Strength=Slider(0, range=0..1))

# ----
pdecon = Deconstruct(Point=nv.NakedPts)  # -> XComponent, YComponent, ZComponent
# Kangaroo Simulation setup
# 
# from basic low-poly mesh to simulated material properties
# 
# code by Alessio Erioli
# 
# v 1.0
# 
# © Co-de-iT 2018 _ Creative Commons Attribution-NonCommercial-ShareAlike 4.0 International License
crv = Curve([medges.InteriorEdges, medges.NakedEdges])
smaller = SmallerThan(FirstNumber=pdecon.ZComponent, SecondNumber=anchor_naked_point_threshold)  # -> SmallerThan, OrEqualTo
len = Length(Curve=crv)
dispatch = Dispatch(List=nv.NakedPts, DispatchPattern=smaller.SmallerThan)  # -> ListA, ListB
avr = Average(Input=len)
multiplication = Multiplication(A=len, B=Slider(1.05, range=0..1.5))
pt = Point(dispatch.ListA)

# ---- group: interactive modification
grab = Grab(On=True, Strength=1, Range=3)  # -> Grab, Anchors

# ---- group: anchor points
anchor = Anchor(Point=pt, Strength=10000)

# ---- group: internal springs
length_line = LengthLine(Line=crv, Length=multiplication, Strength=10)

# ---- group: smooth factor
smooth = Smooth(M=wbcatmullclark, Strength=Slider(0.8, range=0..10))

# ----
show = Show(G=wbcatmullclark)
entwine = Entwine(
    Branch00=show,
    Branch01=length_line,
    Branch02=smooth,
    Branch03=anchor,
    Branch04=angle,
    Branch05=grab.Grab,
    FlattenInputs=True)
solver = Solver(GoalObjects=entwine, Reset=Button(), Threshold=1e-15, Tolerance=0.01, On=Toggle(False))  # -> I, V, O
bang = ExplodeTree(Data=solver.O)  # -> Branch0, Branch1, Branch2
mesh_2 = Mesh(bang.Branch0)
