# Grasshopper definition Part_02_MP.gh (Grasshopper 1.0.5)
# plug-ins: Human, Millipede

area_normal_load = Slider(-802.523, range=-1110..1)

# ---- group: subD mesh
mesh = Mesh(<mesh referenced from the Rhino model>)

# ----
thickness = Slider(0.1, range=0..3)

# ---- group: load BRep
brep = Brep(<brep referenced from the Rhino model>)

# ---- group: support BRep
brep_2 = Brep(<brep referenced from the Rhino model>)

# ----
mat = Material(MaterialType=2)
mat_2 = MillC_StockSupportType(X=True, Y=True, Z=True, RX=True, RY=True, RZ=True)
load_region = LoadRegion(Boundary=brep, ArealNormalLoad=area_normal_load)
support_region = MSupportTypeRegion(Boundary=brep_2, SupportType=mat_2, AmmendExistingSupports=True)
femesh = FEMesh(Meshes=mesh, Material=mat, Thickness=thickness, AreaLoad=Vector(0, 0, 0), NormalAreaLoad=0)
swc = Slider(1, range=0..1)
quad_opt = Slider(4, range=0..18)
opt_target = Slider(0.15, range=0..1)
opt_penal = Slider(2.088, range=0..3)
# Millipede setup
# 
# from relaxed mesh to embodied forces
# 
# code by Alessio Erioli
# 
# v 1.0
# 
# © Co-de-iT 2018 _ Creative Commons Attribution-NonCommercial-ShareAlike 4.0 International License
fe_system = FESystem(
    ModelComponents=[femesh, support_region, load_region],
    IntersectAddedCurves=True,
    MergeTolerance=0.0001,
    MinimumCurveSpan=0.05,
    MaximumCurveSpan=10000,
    CurveTolerance=0.1)

# ----
# Enable component and
# press "Step" until a b/w
# stiffness pattern emerges
# 1
fe_solver = FESolver(
    FEModel=fe_system,
    SelfWeightCoefficient=swc,
    BeamOptimisationIterations=0,
    QuadOptimisationIterations=quad_opt,
    OptimizationTarget=opt_target,
    OptimizationPenalization=opt_penal,
    LoadCase=0,
    AllCases=True)  # -> FEModel, MaxDeflection, Weight; disabled
mesh_visualization = MeshVisualization(FEModel=fe_solver.FEModel, Deflection=0, Plane=1, ShowThickness=False, ColorMode=8)  # -> Mesh, CompleteRange, VisibleRange

# ---- group: save Millipede data
dir_type = ValueList({"desktop": 0, "documents": 1, "GH file path": 2, "C:": 3}, selected="GH file path")
quad_results = QuadResults(FEModel=fe_solver.FEModel, Plane=1)  # -> PrincipalStressFrame, Area, NormalDisplacement, MaxVonMisesStress, PS1, PS2, StiffnessMultiplier, Bending
# Save Millipede data in the chosen folder.
# 
# Take note of the folder name too.
# 2
save = Button()
f_pathg = PathGenerator(type=dir_type, subDir="millipede data_case 01")  # -> dir; inputs type: Int32, subDir: String
# ---------- f_pathg: C# ----------
                           /*
    froGH - a sparse collection of (in)utilities for Grasshopper

    Path Generator
    code by Alessio Erioli - value list generation based on code by James Ramsden

    froGH by Co-de-iT is licensed under a Creative Commons Attribution 4.0 International License.
    http://creativecommons.org/licenses/by/4.0/

    */
    initComp();


    String S = "";
    String root = "";
    String end = "\\";
    String eol = Environment.NewLine;

    // __________________ autoList part __________________

    // variable for the list
    Grasshopper.Kernel.Special.GH_ValueList vList;
    // tries to cast input as list
    try{

      // if the list is not the first parameter then change Input[0] to the corresponding value
      vList = (Grasshopper.Kernel.Special.GH_ValueList) Component.Params.Input[0].Sources[0];
      // Print("value list connected");
      // check if the list must be created
      //if (vList.NickName != "dir type"){
      if (!vList.NickName.Equals("dir type")){
        vList.ClearData();
        vList.ListItems.Clear();
        vList.NickName = "dir type";
        var item1 = new Grasshopper.Kernel.Special.GH_ValueListItem("desktop", "0");
        var item2 = new Grasshopper.Kernel.Special.GH_ValueListItem("documents", "1");
        var item3 = new Grasshopper.Kernel.Special.GH_ValueListItem("GH file path", "2");
        var item4 = new Grasshopper.Kernel.Special.GH_ValueListItem("C:", "3");
        vList.ListItems.Add(item1);
        vList.ListItems.Add(item2);
        vList.ListItems.Add(item3);
        vList.ListItems.Add(item4);

        vList.ListItems[0].Value.CastTo(out type);
      }
    }
    catch{
      // handles anything that is not a value list
    }


    switch(type){
      case 0:
        root = Environment.GetFolderPath(Environment.SpecialFolder.Desktop) + end;
        S = "Desktop";
        break;
      case 1:
        root = Environment.GetFolderPath(Environment.SpecialFolder.MyDocuments) + end;
        S = "Documents";
        break;
      case 2:
        GH_Document ghDoc = owner.OnPingDocument();

        if (ghDoc.IsFilePathDefined)
        {
          int nameLen = ghDoc.DisplayName.TrimEnd('*').Length + 3; // +3 accounts for the '.gh' extension
          int fileLen = ghDoc.FilePath.TrimEnd('*').Length;

          //F = ghDoc.DisplayName.TrimEnd('*');
          root = ghDoc.FilePath.Substring(0, fileLen - nameLen);
          //root = gh_d.FilePath;
          S = "GH File path";
        }
        else
        {
          Print("No path defined. Saving to Desktop until then");
          root = Environment.GetFolderPath(Environment.SpecialFolder.Desktop);
          S = "Desktop";
        }
        break;
      case 3:
        root = "C:" + end;
        S = root + end;
        break;
    }
    dir = root + (subDir != null ? (subDir + end) : "");
    Component.Message = S;
# ---------- f_pathg: C# additional code ----------
  void initComp(){
    Component.Name = "Path Generator";
    Component.NickName = "f_PathG";
    Component.Description = "generates a path based on local direcories such as Desktop, Documents, GH file path";
    Component.Params.Input[0].Name = "dir type";
    Component.Params.Input[0].Description = "directory type: 0 desktop, 1 documents, 2 GH file path, 3 C:\nconnect a value list for automatic list generation";
    Component.Params.Input[1].Name = "custom subdir";
    Component.Params.Input[1].Description = "(optional) custom subdirectory";
  }
# ---------- end f_pathg ----------
c_script = CSharpScript(
    Ps=quad_results.PrincipalStressFrame,
    Area=quad_results.Area,
    W=quad_results.NormalDisplacement,
    S=quad_results.MaxVonMisesStress,
    PS1=quad_results.PS1,
    PS2=quad_results.PS2,
    Opt=quad_results.StiffnessMultiplier,
    Bend=quad_results.Bending,
    dir=f_pathg,
    save=save)  # -> info; inputs Ps: list of Plane, Area: list of Double, W: list of Double, S: list of Double, PS1: list, PS2: list, Opt: list, Bend: list, dir: String, save: Boolean
# ---------- c_script: C# ----------
    string sp = "";
    List<string> planes = new List<string>();
    List<string> areas = new List<string>();
    List<string> ws = new List<string>();
    List<string> ss = new List<string>();
    List<string> ps1s = new List<string>();
    List<string> ps2s = new List<string>();
    List<string> opts = new List<string>();
    List<string> bends = new List<string>();
    Plane p;

    // Convert Planes to String
    for (int i = 0; i < Ps.Count; i++){
      sp = "";
      p = Ps[i];
      sp += p.Origin.X.ToString() + "," + p.Origin.Y.ToString() + "," + p.Origin.Z.ToString() + " ";
      sp += p.XAxis.X.ToString() + "," + p.XAxis.Y.ToString() + "," + p.XAxis.Z.ToString() + " ";
      sp += p.YAxis.X.ToString() + "," + p.YAxis.Y.ToString() + "," + p.YAxis.Z.ToString();
      //sp += "\n";
      planes.Add(sp);
    }

    // Convert Areas
    for (int i = 0; i < Area.Count; i++){
      areas.Add(Area[i].ToString());
    }

    // Convert Ws
    for (int i = 0; i < W.Count; i++){
      ws.Add(W[i].ToString());
    }

    // Convert Ss
    for (int i = 0; i < S.Count; i++){
      ss.Add(S[i].ToString());
    }

    // Convert PS1s
    for (int i = 0; i < PS1.Count; i++){
      ps1s.Add(PS1[i].ToString());
    }

    // Convert PS2s
    for (int i = 0; i < PS2.Count; i++){
      ps2s.Add(PS2[i].ToString());
    }

    // Convert Opts
    for (int i = 0; i < Opt.Count; i++){
      opts.Add(Opt[i].ToString());
    }

    // Convert Bends
    for (int i = 0; i < Bend.Count; i++){
      bends.Add(Bend[i].ToString());
    }

    // _____________________ saving files _________________________

    if (save){
      if (!Directory.Exists(dir)) Directory.CreateDirectory(dir);

      // planes
      String target = dir + "PS.txt";
      System.IO.File.WriteAllLines(target, planes.ToArray());

      // areas
      target = dir + "Area.txt";
      System.IO.File.WriteAllLines(target, areas.ToArray());

      // Ws
      target = dir + "W.txt";
      System.IO.File.WriteAllLines(target, ws.ToArray());

      // Ss
      target = dir + "S.txt";
      System.IO.File.WriteAllLines(target, ss.ToArray());

      // PS1s
      target = dir + "PS1.txt";
      System.IO.File.WriteAllLines(target, ps1s.ToArray());

      // PS2s
      target = dir + "PS2.txt";
      System.IO.File.WriteAllLines(target, ps2s.ToArray());

      // Opts
      target = dir + "Opt.txt";
      System.IO.File.WriteAllLines(target, opts.ToArray());

      // Bends
      target = dir + "Bending.txt";
      System.IO.File.WriteAllLines(target, bends.ToArray());

      info = "all files saved in " + dir;

    } else {
      info = "press save button to save file";
    }
# ---------- end c_script ----------
panel = Panel(c_script)

# ----
# Optional
# 
# bake this mesh if you want
# (you might later use the b/w
# values to control crest height)
mesh_2 = Mesh(mesh_visualization.Mesh)

# ---- group: display principal stresses
length = Slider(0.145, range=0..0.2)
deplane = DeconstructPlane(Plane=quad_results.PrincipalStressFrame)  # -> Origin, XAxis, YAxis, ZAxis
line = LineSDL(Start=deplane.Origin, Direction=deplane.XAxis, Length=length)
line_2 = LineSDL(Start=deplane.Origin, Direction=deplane.YAxis, Length=length)
ps2 = ColourSwatch(SwatchColor=RGB(8, 255, 0))
ps1 = ColourSwatch(SwatchColor=RGB(255, 0, 0))
# Optional
# 
# preview principal stresses direction
previewlw = CustomPreviewLineweights(Geometry=line, Shader=ps1, Absolute=False)
previewlw_2 = CustomPreviewLineweights(Geometry=line_2, Shader=ps2, Absolute=False)
