# Grasshopper definition Part_03-01_box morph mesh.gh (Grasshopper 1.0.5)
# Copyright: Co-de-iT
# plug-ins: MeshEdit Components, Human, Weaverbird, Kangaroo2 Components

# single face (for testing)
mesh = Mesh(<mesh referenced from the Rhino model>)
# actual mesh
mesh_2 = Mesh(<mesh referenced from the Rhino model>)
wbcatmullclark = WeaverbirdsCatmullClarkSubdivision(MeshCurves=mesh_2, Level=Slider(3, range=1..3), SmoothNakedEdges=Slider(2, range=0..2))
# field curves
crv = Curve([<curve referenced from the Rhino model> x2])

mesh_3 = Mesh([<mesh referenced from the Rhino model> x4])

crv_2 = Curve([<curve referenced from the Rhino model> x2])
bbox = BoundingBox(Content=crv_2, Plane=PlaneXY(0, 0, 0), UnionBox=True)  # -> Box, Box_2

wbjoin = WeaverbirdsJoinMeshesAndWeld(Mesh=mesh_3, Weld=True)

# ----
# component geometry
# reference bounding box
merge = Merge(Data1=wbjoin)
group = Group(Objects=merge)

box = EvaluateBox(Box=bbox.Box, UParameter=0.5, VParameter=0.5, WParameter=0.5)  # -> Plane, Point, Include
# generates 2 possible component rotations, using the Bounding Box: 0 and 90° (compliant or perpendicular to the vector field)
panel = Panel("0 to Pi")
range = Range(Domain=panel, Steps="2")
cull_i = CullIndex(List=range, Indices="-1", Wrap=True)
Z = UnitZ(Factor=1)
rot3d = Rotate3D(Geometry=bbox.Box, Angle=cull_i, Center=box.Point, Axis=Z)  # -> flatten(Geometry), Transform

# ---- group: modulat height by distance form naked edge
nv = NakedVertices(Mesh=wbcatmullclark)  # -> ClothedIndex, NakedIndex, ClothedPts, NakedPts
dom = ConstructDomain(DomainStart=0, DomainEnd=1)

# ----
# <title>
# 
# <description>
# 
# code by <author>
# 
# v <version>
# 
# © Co-de-iT 2018 _ Creative Commons Attribution-NonCommercial-ShareAlike 4.0 International License
demesh = DeconstructMesh(Mesh=wbcatmullclark)  # -> Vertices, Faces, Colours, Normals
vertex_offset = Slider(2.211, range=0..5)
deface = DeconstructFace(Face=graft(demesh.Faces))  # -> CornerA, CornerB, CornerC, CornerD
merge_2 = Merge(Data1=deface.CornerA, Data2=deface.CornerB, Data3=deface.CornerC, Data4=deface.CornerD)
# find the 4 vertices and
# their displaced versions
# for each face
item = ListItem(List=demesh.Vertices, Index=merge_2, Wrap=True)  # -> simplify(Item)

# ---- group: modulat height by distance form naked edge (continued)
cp = ClosestPoint(Point=demesh.Vertices, Cloud=nv.NakedPts)  # -> ClosestPoint, CPIndex, Distance
num = Number(cp.Distance)
bnd = Bounds(Numbers=flatten(num))
remap = RemapNumbers(Value=num, Source=bnd, Target=dom)  # -> Mapped, Clipped
graph = GraphMapper(
    remap.Mapped,
    x0=0,
    x1=1,
    y0=0,
    y1=1,
    container_name="Bezier",
    cpx=[0, 0.2563068271, 0.9127152562, 1],
    cpy=[0.04716956615, 0.06230098009, 0.9481608272, 1])
gradient = Gradient(LowerLimit=0, UpperLimit=1, Parameter=graph, stops=[0: RGB(0, 0, 0), 1: RGB(255, 255, 255)])
conmesh = ConstructMesh(Vertices=demesh.Vertices, Faces=demesh.Faces, Colours=gradient)

# ----
multiplication = Multiplication(A=vertex_offset, B=graph)
amp = Amplitude(Vector=demesh.Normals, Amplitude=multiplication)
move = Move(Geometry=demesh.Vertices, Motion=amp)  # -> Geometry, Transform
item_2 = ListItem(List=move.Geometry, Index=merge_2, Wrap=True)  # -> simplify(Item)

item_3 = ListItem(List=item, Index=0, Wrap=True)  # -> Item, Item1, Item2, Item3
item_4 = ListItem(List=item_2, Index=0, Wrap=True)  # -> Item, Item1, Item2, Item3
# create twisted boxes
tbox = TwistedBox(
    CornerA=item_3.Item,
    CornerB=item_3.Item1,
    CornerC=item_3.Item2,
    CornerD=item_3.Item3,
    CornerE=item_4.Item,
    CornerF=item_4.Item1,
    CornerG=item_4.Item2,
    CornerH=item_4.Item3)  # -> flatten(TwistedBox)

# ----
# vector field per face
avr = Average(Input=item)
divlength = DivideLength(Curve=crv, Length=Slider(1, range=0.05..2))  # -> flatten(Points), flatten(Tangents), Parameters
cp_2 = ClosestPoint(Point=avr, Cloud=divlength.Points)  # -> ClosestPoint, CPIndex, Distance
item_5 = ListItem(List=divlength.Tangents, Index=cp_2.CPIndex, Wrap=True)

# ----
# I need a reference direction for each mesh face (this can be the Millipede field)
item_6 = ListItem(List=item, Index=0, Wrap=True)  # -> Item, Item1, Item2, Item3
avr_2 = Average(Input=[item_6.Item2, item_6.Item3])
# insert here >>
# the vector information from Millipede
ln = Line(StartPoint=avr, EndPoint=avr_2)

unit = UnitVector(Vector=ln)
vec = Vector(item_5)

angle = Angle(VectorA=vec, VectorB=unit)  # -> Angle, Reflex
# orient by minimum angle
panel_2 = Panel("45")
sin = Sine(Value=angle.Angle)
sin_2 = Sine(Value=degrees(panel_2))
abs = Absolute(Value=sin)
larger = LargerThan(FirstNumber=abs, SecondNumber=sin_2)  # -> LargerThan, OrEqualTo

vdisex = VectorDisplayEx(Point=avr, Vector=vec, Colour=vec, Width=2)

int = Integer(flatten(larger.LargerThan))
panel_3 = Panel(int)
item_7 = ListItem(List=rot3d.Geometry, Index=int, Wrap=True)
morph = BoxMorph(Geometry=group, Reference=item_7, Target=tbox)
ungroup = Ungroup(Group=morph)

split = SplitList(List=ungroup, Index="1")  # -> ListA, ListB
mjoin = MeshJoin(Meshes=flatten(split.ListA))
weldvertices = MeshWeldVertices(Mesh=mjoin, Tolerance=0.01)  # -> RuntimeMessage, Mesh
crv_3 = Curve(split.ListB)
previewlw = CustomPreviewLineweights(Geometry=crv_3, Shader=ColourSwatch(SwatchColor=RGB(0, 0, 0)), Absolute=False)

mesh_4 = Mesh(weldvertices.Mesh)

medges = MeshEdges(Mesh=mesh_4)  # -> NakedEdges, InteriorEdges, NonManifoldEdges
preview = CustomPreview(Geometry=mesh_4, Material=ColourSwatch(SwatchColor=RGB(255, 255, 255)))
