# Grasshopper definition Part_03_Detail.gh (Grasshopper 1.0.5)
# Copyright: Co-de-iT
# plug-ins: Weaverbird, Mesh Pipe

case = ValueList({"01": 0, "02": 1}, selected="01")
# Read data from file and
# internalize values in components
dir_type = ValueList({"desktop": 0, "documents": 1, "GH file path": 2, "C:": 3}, selected="GH file path")
orient_by = ValueList({"X stress": 0, "Y stress": 1, "custom combination": 2}, selected="Y stress")
crease_height = ValueList({"uniform": 0, "by stress": 1, "uniform + z dampening": 2}, selected="by stress")
crease_height_uniform = Slider(0.08, range=0..1)
min_height = Slider(0.1, range=0..1)
max_height = Slider(0.4, range=0..1)
crease_height_uniform_z_damp = Slider(0.2, range=0..1)
data_directory_name = Panel("millipede data_case ")
filter = StreamFilter(Gate=case, Stream0="01", Stream1="02")
concat = Concatenate(FragmentA=data_directory_name, FragmentB=filter)
f_pathg = PathGenerator(type=dir_type, subDir=concat)  # -> dir; inputs type: Int32, subDir: String
# ---------- f_pathg: C# ----------
                           /*
    froGH - a sparse collection of (in)utilities for Grasshopper

    Path Generator
    code by Alessio Erioli - value list generation based on code by James Ramsden

    froGH by Co-de-iT is licensed under a Creative Commons Attribution 4.0 International License.
    http://creativecommons.org/licenses/by/4.0/

    */
    initComp();


    String S = "";
    String root = "";
    String end = "\\";
    String eol = Environment.NewLine;

    // __________________ autoList part __________________

    // variable for the list
    Grasshopper.Kernel.Special.GH_ValueList vList;
    // tries to cast input as list
    try{

      // if the list is not the first parameter then change Input[0] to the corresponding value
      vList = (Grasshopper.Kernel.Special.GH_ValueList) Component.Params.Input[0].Sources[0];
      // Print("value list connected");
      // check if the list must be created
      //if (vList.NickName != "dir type"){
      if (!vList.NickName.Equals("dir type")){
        vList.ClearData();
        vList.ListItems.Clear();
        vList.NickName = "dir type";
        var item1 = new Grasshopper.Kernel.Special.GH_ValueListItem("desktop", "0");
        var item2 = new Grasshopper.Kernel.Special.GH_ValueListItem("documents", "1");
        var item3 = new Grasshopper.Kernel.Special.GH_ValueListItem("GH file path", "2");
        var item4 = new Grasshopper.Kernel.Special.GH_ValueListItem("C:", "3");
        vList.ListItems.Add(item1);
        vList.ListItems.Add(item2);
        vList.ListItems.Add(item3);
        vList.ListItems.Add(item4);

        vList.ListItems[0].Value.CastTo(out type);
      }
    }
    catch{
      // handles anything that is not a value list
    }


    switch(type){
      case 0:
        root = Environment.GetFolderPath(Environment.SpecialFolder.Desktop) + end;
        S = "Desktop";
        break;
      case 1:
        root = Environment.GetFolderPath(Environment.SpecialFolder.MyDocuments) + end;
        S = "Documents";
        break;
      case 2:
        GH_Document ghDoc = owner.OnPingDocument();

        if (ghDoc.IsFilePathDefined)
        {
          int nameLen = ghDoc.DisplayName.TrimEnd('*').Length + 3; // +3 accounts for the '.gh' extension
          int fileLen = ghDoc.FilePath.TrimEnd('*').Length;

          //F = ghDoc.DisplayName.TrimEnd('*');
          root = ghDoc.FilePath.Substring(0, fileLen - nameLen);
          //root = gh_d.FilePath;
          S = "GH File path";
        }
        else
        {
          Print("No path defined. Saving to Desktop until then");
          root = Environment.GetFolderPath(Environment.SpecialFolder.Desktop);
          S = "Desktop";
        }
        break;
      case 3:
        root = "C:" + end;
        S = root + end;
        break;
    }
    dir = root + (subDir != null ? (subDir + end) : "");
    Component.Message = S;
# ---------- f_pathg: C# additional code ----------
  void initComp(){
    Component.Name = "Path Generator";
    Component.NickName = "f_PathG";
    Component.Description = "generates a path based on local direcories such as Desktop, Documents, GH file path";
    Component.Params.Input[0].Name = "dir type";
    Component.Params.Input[0].Description = "directory type: 0 desktop, 1 documents, 2 GH file path, 3 C:\nconnect a value list for automatic list generation";
    Component.Params.Input[1].Name = "custom subdir";
    Component.Params.Input[1].Description = "(optional) custom subdirectory";
  }
# ---------- end f_pathg ----------
cluster = Cluster(directory=f_pathg)  # -> principal_stress_planes, principal_stress_1, principal_stress_2, max_von_mises_stress
data_directory_name_2 = Panel(f_pathg)
dom = ConstructDomain(DomainStart=min_height, DomainEnd=max_height)

# ---- group: Refined mesh
mesh = Mesh(<mesh referenced from the Rhino model>)
mesh_2 = Mesh(<mesh referenced from the Rhino model>)

# ----
# Detailing mesh
# 
# from embodied forces to final mesh
# 
# code by Alessio Erioli
# 
# v 1.0
# 
# © Co-de-iT 2018 _ Creative Commons Attribution-NonCommercial-ShareAlike 4.0 International License
filter_2 = StreamFilter(Gate=case, Stream0=mesh, Stream1=mesh_2)

# ---- group: stress planes
pln = Plane(cluster.principal_stress_planes)

# ---- group: Principal Stress 1
num = Number(cluster.principal_stress_1)

# ----
demesh = DeconstructMesh(Mesh=filter_2)  # -> Vertices, Faces, Colours, Normals
f_mf2vval = MeshFacesToVerticesValues(M=filter_2, Vf=num)  # -> Vv; inputs M: Mesh, Vf: list of Double, m: Boolean
#   port m: calculation method: simple or weighted average
# ---------- f_mf2vval: C# ----------
                                                                                                                                                                                                                                                                /*
    froGH - a sparse collection of (in)utilities for Grasshopper

    Convert per-Face values into per-Vertex values

    parallelization occurs after 1000 elements

    code by Alessio Erioli

    froGH by Co-de-iT is licensed under a Creative Commons Attribution 4.0 International License.
    http://creativecommons.org/licenses/by/4.0/

    */
    initComp(m);

    int pThres = 1000; // parallelization threshold

    if (M != null && Vf.Count > 0){

      if (Vf.Count == M.Faces.Count){

        List <double> vVerts = new List<double>(); // per-Vertices values

        if (Vf.Count < pThres){

          int[] vFaces;
          double vVal, vD, dists;
          Point3d v;

          for (int i = 0; i < M.Vertices.Count; i++){

            vVal = 0;
            vD = 0;
            dists = 0;

            // get faces shared by vertex
            vFaces = M.Vertices.GetVertexFaces(i);

            // get the values

            if (m){

              // get vertex
              v = (Point3d) M.Vertices[i];

              // _____________________  weighted average method

              for (int j = 0; j < vFaces.Length; j++){

                // get distances from face center
                vD = v.DistanceTo(getFaceCenter(M, j));

                // add weighted value
                vVal += Vf[vFaces[j]] * vD;
                // update sum of distances
                dists += vD;
              }

              // weight average
              vVal /= dists;

              vVerts.Add(vVal);

            }else{

              // _____________________  standard average method

              for (int j = 0; j < vFaces.Length; j++){
                vVal += Vf[vFaces[j]];
              }
              // average
              vVal /= vFaces.Length;

              vVerts.Add(vVal);

            }
          }

          Vv = vVerts;

        }else{

          var mFv = new System.Collections.Concurrent.ConcurrentDictionary<int, double>(Environment.ProcessorCount, Vf.Count);
          List<int> vInd = new List<int>();

          for(int i = 0; i < M.Vertices.Count; i++){
            vInd.Add(i);
          }

          foreach(int i in vInd) mFv[i] = 0; // initialise dictionary

          if(m){

            System.Threading.Tasks.Parallel.ForEach(vInd, i =>
              {
              // weighted average calculation

              Point3d v = (Point3d) M.Vertices[i];
              int[] vFaces = M.Vertices.GetVertexFaces(i);
              double vVal = 0, dists = 0, vD = 0;

              for (int j = 0; j < vFaces.Length; j++){
                // get distances from face center
                vD = v.DistanceTo(getFaceCenter(M, j));

                // add weighted value
                vVal += Vf[vFaces[j]] * vD;
                // update sum of distances
                dists += vD;
              }
              // average
              vVal /= dists;
              mFv[i] = vVal;
              }
              );

            Vv = mFv.Values;

          }else{

            System.Threading.Tasks.Parallel.ForEach(vInd, i =>
              {
              // standard average calculation
              int[] vFaces = M.Vertices.GetVertexFaces(i);
              double vVal = 0;
              for (int j = 0; j < vFaces.Length; j++){
                vVal += Vf[vFaces[j]];
              }
              // average
              vVal /= vFaces.Length;
              mFv[i] = vVal;
              }
              );

            Vv = mFv.Values;
          }
        }
      }
    }
# ---------- f_mf2vval: C# additional code ----------
  void initComp(bool m){
    Component.Name = "Mesh Faces to Vertices values";
    Component.NickName = "f_MF2VVal";
    Component.Description = "Converts per-face into per-vertex values";
    Component.Message = m ? "weighted" : "simple";
    Component.Params.Input[0].Name = "Mesh";
    Component.Params.Input[0].Description = "Input Mesh";
    Component.Params.Input[1].Name = "Values per faces";
    Component.Params.Input[1].Description = "List of values (one for each face)";
    Component.Params.Input[2].Name = "Method";
    Component.Params.Input[2].Description = "calculation method:\nsimple or weighted average";
    Component.Params.Output[0].Name = "Values per vertices";
    Component.Params.Output[0].Description = "Values distributed per vertices";
  }


  public Point3d getFaceCenter(Mesh M, int fInd){
    MeshFace f = M.Faces[fInd];
    Point3d c = new Point3d();
    if (f.IsValid(M.Vertices.Count)){
      c = Point3d.Add(c, (Point3d) M.Vertices[f.A]);
      c = Point3d.Add(c, (Point3d) M.Vertices[f.B]);
      c = Point3d.Add(c, (Point3d) M.Vertices[f.C]);
      if (f.IsQuad){
        c = Point3d.Add(c, (Point3d) M.Vertices[f.D]);
      }
    }
    c /= f.IsQuad ? 4 : 3;
    return c;
  }
# ---------- end f_mf2vval ----------
pdecon = Deconstruct(Point=demesh.Vertices)  # -> XComponent, YComponent, ZComponent

# ---- group: height by Principal Stress
num_2 = Number(f_mf2vval)
bnd = Bounds(Numbers=flatten(num_2))
remap = RemapNumbers(Value=num_2, Source=bnd, Target=Domain(0, 1))  # -> Mapped, Clipped
graph = GraphMapper(
    remap.Mapped,
    x0=0,
    x1=1,
    y0=0,
    y1=1,
    container_name="Bezier",
    cpx=[0, 0.3505510092, 0.6251017451, 1],
    cpy=[0, 0.05263710022, 0.9653329253, 1])

# ---- group: Z height dampening
num_3 = Number(pdecon.ZComponent)
bnd_2 = Bounds(Numbers=flatten(num_3))
remap_2 = RemapNumbers(Value=num_3, Source=bnd_2, Target=Domain(0, 1))  # -> Mapped, Clipped
graph_2 = GraphMapper(
    remap_2.Mapped,
    x0=0,
    x1=1,
    y0=0,
    y1=1,
    container_name="Bezier",
    cpx=[0, 0.8237454891, 0.6370319128, 1],
    cpy=[0.4205799699, 0, 1, 0.4355822802])

# ----
remap_3 = RemapNumbers(Value=graph, Source=Domain(0, 1), Target=dom)  # -> Mapped, Clipped

# ---- group: sort stress planes by face
facen = FaceNormals(Mesh=filter_2)  # -> flatten(Centers), Normals
cp = ClosestPoint(Point=facen.Centers, Cloud=pln)  # -> ClosestPoint, CPIndex, Distance
item = ListItem(List=pln, Index=cp.CPIndex, Wrap=True)

# ----
multiplication = Multiplication(A=crease_height_uniform_z_damp, B=graph_2)
multiplication_2 = Multiplication(A=remap_3.Mapped, B=graph_2)
filter_3 = StreamFilter(Gate=crease_height, Stream0=crease_height_uniform, Stream1=multiplication_2, Stream2=multiplication)
multiplication_3 = Multiplication(A=demesh.Normals, B=filter_3)
deplane = DeconstructPlane(Plane=item)  # -> Origin, XAxis, YAxis, ZAxis
filter_4 = StreamFilter(Gate=orient_by, Stream0=deplane.XAxis, Stream1=deplane.YAxis)
move = Move(Geometry=demesh.Vertices, Motion=multiplication_3)  # -> Geometry, Transform
cluster_2 = Cluster_2(
    stress_vector=filter_4,
    original_mesh_vertices=demesh.Vertices,
    modified_mesh_vertices=move.Geometry,
    face_structure=demesh.Faces)  # -> crest_polylines, crest_mesh, modified_vertices_per_face, edge_midpoint_per_face, face_structure_2

# ---- group: warning! > 30 sec calculation
cluster_3 = Cluster_3(
    crest_polylines=cluster_2.crest_polylines,
    modified_vertices_per_face=cluster_2.modified_vertices_per_face,
    edge_midpoint_per_face=cluster_2.edge_midpoint_per_face,
    face_structure=cluster_2.face_structure_2)  # -> crest_curves, modified_mesh; disabled

# ----
mpipe = MeshPipe(Curve=cluster_2.crest_polylines, Radius=Slider(0.01, range=0..0.1), Accuracy=0.2, Rotation=0, Segments="4", Caps=1)
mpipe_2 = MeshPipe(Curve=cluster_3.crest_curves, Radius=Slider(0.01, range=0..0.1), Accuracy=0.2, Rotation=0, Segments="4", Caps=1)
mesh_3 = Mesh(cluster_2.crest_mesh)
mjoin = MeshJoin(Meshes=flatten(mpipe))
mjoin_2 = MeshJoin(Meshes=flatten(mpipe_2))
mesh_4 = Mesh(cluster_3.modified_mesh)
preview = CustomPreview(Geometry=mesh_4, Material=ColourSwatch(SwatchColor=RGB(255, 255, 255)))
preview_2 = CustomPreview(Geometry=mjoin_2, Material=ColourSwatch(SwatchColor=RGB(36, 214, 208)))
preview_3 = CustomPreview(Geometry=mjoin, Material=ColourSwatch(SwatchColor=RGB(214, 190, 36)))
preview_4 = CustomPreview(Geometry=mesh_3, Material=ColourSwatch(SwatchColor=RGB(255, 255, 255)))

# ---- group: subdivide & attach pipes to new mesh
wbcatmullclark = WeaverbirdsCatmullClarkSubdivision(MeshCurves=cluster_2.crest_mesh, Level="2", SmoothNakedEdges=1)
explode = Explode(Curve=cluster_2.crest_polylines, Recursive=True)  # -> Segments, Vertices
demesh_2 = DeconstructMesh(Mesh=wbcatmullclark)  # -> Vertices, Faces, Colours, Normals
mpipe_3 = MeshPipe(Curve=cluster_2.crest_polylines, Radius=Slider(0.01, range=0..0.1), Accuracy=0.2, Rotation=0, Segments="4", Caps=1)
mjoin_3 = MeshJoin(Meshes=flatten(mpipe_3))
wbcatmullclark_2 = WeaverbirdsCatmullClarkSubdivision(MeshCurves=mjoin_3, Level="2", SmoothNakedEdges=1)

# ---- group: subdivide & attach pipes to new mesh / > 1 minute!!!
cp_2 = ClosestPoint(Point=explode.Vertices, Cloud=demesh_2.Vertices)  # -> ClosestPoint, CPIndex, Distance; disabled

# ---- group: subdivide & attach pipes to new mesh (continued)
pline = PolyLine(Vertices=cp_2.ClosestPoint, Closed=False)

# ----
preview_5 = CustomPreview(Geometry=mjoin_3, Material=ColourSwatch(SwatchColor=RGB(214, 190, 36)))  # disabled

# ==== cluster Cluster
directory = ClusterInput()
c_script = CSharpScript(dir=directory)  # -> out, F; inputs dir: String
# ---------- c_script: C# ----------
    if (Directory.Exists(dir)){

      //string Dir = Path.GetDirectoryName(first_frame);
      string [] fileEntries = Directory.GetFiles(dir);
      F = fileEntries;
    } else {

      F = null;
    }
# ---------- end c_script ----------
item = ListItem(List=c_script.F, Index=0, Wrap=True)  # -> Item, Item1, Item2, Item3, Item4, Item5, Item6
file = ReadFile(File=item.Item5, PerLineParse=True)
file_2 = ReadFile(File=item.Item4, PerLineParse=True)
file_3 = ReadFile(File=item.Item3, PerLineParse=True)
file_4 = ReadFile(File=item.Item6, PerLineParse=True)
split = TextSplit(Text=file_3, Separators=" ")
item_2 = ListItem(List=split, Index=0, Wrap=True)  # -> Item, Item1, Item2
pl = ConstructPlane(Origin=item_2.Item, XAxis=item_2.Item1, YAxis=item_2.Item2)  # -> flatten(Plane)
num = Number(file)
num_2 = Number(file_2)
num_3 = Number(file_4)
max_von_mises_stress = ClusterOutput(num_3)
principal_stress_planes = ClusterOutput(pl)
principal_stress_1 = ClusterOutput(num_2)
principal_stress_2 = ClusterOutput(num)

# ==== cluster Cluster_2
stress_vector = ClusterInput()
original_mesh_vertices = ClusterInput()
modified_mesh_vertices = ClusterInput()
face_structure = ClusterInput()

# ---- group: transform into vertex-per-face structure
deface = DeconstructFace(Face=graft(face_structure))  # -> CornerA, CornerB, CornerC, CornerD
merge = Merge(Data1=deface.CornerA, Data2=deface.CornerB, Data3=deface.CornerC, Data4=deface.CornerD)

# ----
item = ListItem(List=original_mesh_vertices, Index=merge, Wrap=True)
item_2 = ListItem(List=item, Index=0, Wrap=True)  # -> Item, Item1, Item2, Item3

# ---- group: 0-1
avr = Average(Input=[item_2.Item, item_2.Item1])

# ---- group: 1-2
avr_2 = Average(Input=[item_2.Item1, item_2.Item2])

# ---- group: 2-3
avr_3 = Average(Input=[item_2.Item2, item_2.Item3])

# ---- group: 3-0
avr_4 = Average(Input=[item_2.Item, item_2.Item3])

# ----
ln = Line(StartPoint=item_2.Item, EndPoint=item_2.Item2)
ln_2 = Line(StartPoint=item_2.Item1, EndPoint=item_2.Item3)

# ---- group: edge midpoints per face
merge_2 = Merge(Data1=avr, Data2=avr_2, Data3=avr_3, Data4=avr_4)

# ---- group: modified vertices per face
item_3 = ListItem(List=modified_mesh_vertices, Index=merge, Wrap=True)

# ----
merge_3 = Merge(Data1=ln, Data2=ln_2)

# ---- group: sort diagonal by minimum angle with X and Y stress plane vectors
dprod = DotProduct(VectorA=merge_3, VectorB=graft(stress_vector), Unitize=True)
panel = Panel("""0
1""")
abs = Absolute(Value=dprod)
sort = SortList(Keys=abs, ValuesA=merge_3, ValuesB=panel)  # -> Keys, ValuesA, ValuesB

# ---- group: diagonal lines
item_4 = ListItem(List=sort.ValuesA, Index=0, Wrap=True)  # disabled

# ---- group: diagonal indexes
item_5 = ListItem(List=sort.ValuesB, Index=0, Wrap=True)

# ---- group: crest polylines
_0_2_diag = Panel("""0
2""")
_1_3_diag = Panel("""1
3""")
weave = Weave(Pattern=item_5, Stream0=_0_2_diag, Stream1=_1_3_diag, NullGaps=False)
item_6 = ListItem(List=item_3, Index=weave, Wrap=True)
pline = PolyLine(Vertices=item_6, Closed=False)
join = JoinCurves(Curves=flatten(pline), Preserve=False)

# ---- group: crest mesh
_0_2_diag_2 = Panel("""T{2;3;1}
Q{0;1;3;4}
Q{4;5;7;0}
T{6;7;5}""")
_1_3_diag_2 = Panel("""T{0;1;7}
Q{1;2;6;7}
Q{3;5;6;2}
T{4;5;3}""")
weave_2 = Weave(Pattern=[0, 1], Stream0=item_3, Stream1=merge_2, NullGaps=False)
weave_3 = Weave(Pattern=item_5, Stream0=_0_2_diag_2, Stream1=_1_3_diag_2, NullGaps=False)
conmesh = ConstructMesh(Vertices=weave_2, Faces=weave_3)
wbjoin = WeaverbirdsJoinMeshesAndWeld(Mesh=flatten(conmesh), Weld=True)
unifynormals = MeshUnifyNormals(Mesh=wbjoin)

# ----
face_structure_2 = ClusterOutput(weave_3)
modified_vertices_per_face = ClusterOutput(item_3)
edge_midpoint_per_face = ClusterOutput(merge_2)
crest_mesh = ClusterOutput(unifynormals)
crest_polylines = ClusterOutput(join)

# ==== cluster Cluster_3
modified_vertices_per_face = ClusterInput()
edge_midpoint_per_face = ClusterInput()
face_structure = ClusterInput()
crest_polylines = ClusterInput()
explode = Explode(Curve=crest_polylines, Recursive=True)  # -> Segments, Vertices
item = ListItem(List=explode.Vertices, Index=0, Wrap=True)  # -> Item1, Item
dist = Distance(PointA=item.Item1, PointB=item.Item)
smaller = SmallerThan(FirstNumber=dist, SecondNumber="0.01")  # -> SmallerThan, OrEqualTo
nurbs = NurbsCurve(Vertices=explode.Vertices, Degree=3, Periodic=smaller.SmallerThan)  # -> flatten(Curve), Length, Domain

# ---- group: move crease points to curves / > 30 sec!
crv_cp = CurveClosestPoint(Point=graft(modified_vertices_per_face), Curve=nurbs.Curve)  # -> Point, Parameter, Distance

# ---- group: move crease points to curves
sort = SortList(Keys=crv_cp.Distance, ValuesA=crv_cp.Point)  # -> Keys, ValuesA
item_2 = ListItem(List=sort.ValuesA, Index=0, Wrap=True)
pshift = ShiftPaths(Data=item_2, Offset=-1)

# ----
weave = Weave(Pattern=[0, 1], Stream0=pshift, Stream1=edge_midpoint_per_face, NullGaps=False)
conmesh = ConstructMesh(Vertices=weave, Faces=face_structure)
wbjoin = WeaverbirdsJoinMeshesAndWeld(Mesh=flatten(conmesh), Weld=True)
unifynormals = MeshUnifyNormals(Mesh=wbjoin)
modified_mesh = ClusterOutput(unifynormals)
crest_curves = ClusterOutput(nurbs.Curve)
