# Grasshopper definition Part_04-Ivy_00 mesh graph structure_basic.gh (Grasshopper 1.0.5)
# Copyright: Co-de-iT
# plug-ins: MeshEdit Components, Human, Ivy, Weaverbird

# ---- group: mesh from surface
# . choose a mesh (use it like a surface)
# . choose a segmentation diagram
# . choose fields (stress and/or other)
# . generate implied structure
number_slider = Slider(16, range=2..50)
srf = Surface(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)
# channeling structural infomation through creasing patterns on surface-based architectural artifacts
mesh_uv = MeshSurface(Surface=srf, UCount=number_slider, VCount=number_slider, Overhang=True, Equalize=False)

# ----
triangulate_mesh = ValueList({"no": 0, "yes": 1}, selected="yes")

# ---- group: stress planes
# use the values from Millipede here
pln = Plane([Plane(origin=(12.18368411, 1.257946104, 3.137538493), x=(0.6510807494, 0.7589714783, -0.007493520755), y=(0.751072716, -0.6428181008, 0.1505810894)), Plane(origin=(11.46605325, 1.255945235, 2.991218925), x=(0.660466397, 0.7397361808, 0.1287420724), y=(0.6932280176, -0.666620693, 0.2739557763)), Plane(origin=(10.74842215, 1.253944367, 2.724816322), x=(-0.3309945635, 0.9165192209, -0.2245776405), y=(-0.8501693522, -0.392910908, -0.3504755213)), Plane(origin=(10.03079081, 1.251943529, 2.369814694), x=(-0.6416458734, 0.6558564607, -0.3976718195), y=(-0.595322585, -0.7527699336, -0.2809420703)), Plane(origin=(9.313159704, 1.24994269, 1.957698196), x=(-0.699712306, 0.5523179295, -0.4531529472), y=(-0.4876751807, -0.8327823074, -0.2620048599)), Plane(origin=(8.595528841, 1.247941822, 1.519950598), x=(-0.8438621891, 0.07558918727, -0.5312088861), y=(-0.07404156558, -0.9969604215, -0.02424385347))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])

# ---- group: per face values
num = Number([3986694844, 1816723345, 791610266.3, 199277553.8, 235203184.2, 181485238.4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])

# ----
mesh = Mesh(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)

# ---- group: input mesh
mesh_2 = Mesh(mesh)

# ---- group: triangulate - custom
cluster = Cluster(mesh=mesh_2, tri_citeria=Slider(1, range=0..1))

# ----
f_mf2vval = MeshFacesToVerticesValues(M=mesh_2, Vf=num)  # -> Vv; inputs M: Mesh, Vf: list of Double, m: Boolean
#   port m: calculation method: simple or weighted average
# ---------- f_mf2vval: C# ----------
                                                                                                                                                                                                                                                                /*
    froGH - a sparse collection of (in)utilities for Grasshopper

    Convert per-Face values into per-Vertex values

    parallelization occurs after 1000 elements

    code by Alessio Erioli

    froGH by Co-de-iT is licensed under a Creative Commons Attribution 4.0 International License.
    http://creativecommons.org/licenses/by/4.0/

    */
    initComp(m);

    int pThres = 1000; // parallelization threshold

    if (M != null && Vf.Count > 0){

      if (Vf.Count == M.Faces.Count){

        List <double> vVerts = new List<double>(); // per-Vertices values

        if (Vf.Count < pThres){

          int[] vFaces;
          double vVal, vD, dists;
          Point3d v;

          for (int i = 0; i < M.Vertices.Count; i++){

            vVal = 0;
            vD = 0;
            dists = 0;

            // get faces shared by vertex
            vFaces = M.Vertices.GetVertexFaces(i);

            // get the values

            if (m){

              // get vertex
              v = (Point3d) M.Vertices[i];

              // _____________________  weighted average method

              for (int j = 0; j < vFaces.Length; j++){

                // get distances from face center
                vD = v.DistanceTo(getFaceCenter(M, j));

                // add weighted value
                vVal += Vf[vFaces[j]] * vD;
                // update sum of distances
                dists += vD;
              }

              // weight average
              vVal /= dists;

              vVerts.Add(vVal);

            }else{

              // _____________________  standard average method

              for (int j = 0; j < vFaces.Length; j++){
                vVal += Vf[vFaces[j]];
              }
              // average
              vVal /= vFaces.Length;

              vVerts.Add(vVal);

            }
          }

          Vv = vVerts;

        }else{

          var mFv = new System.Collections.Concurrent.ConcurrentDictionary<int, double>(Environment.ProcessorCount, Vf.Count);
          List<int> vInd = new List<int>();

          for(int i = 0; i < M.Vertices.Count; i++){
            vInd.Add(i);
          }

          foreach(int i in vInd) mFv[i] = 0; // initialise dictionary

          if(m){

            System.Threading.Tasks.Parallel.ForEach(vInd, i =>
              {
              // weighted average calculation

              Point3d v = (Point3d) M.Vertices[i];
              int[] vFaces = M.Vertices.GetVertexFaces(i);
              double vVal = 0, dists = 0, vD = 0;

              for (int j = 0; j < vFaces.Length; j++){
                // get distances from face center
                vD = v.DistanceTo(getFaceCenter(M, j));

                // add weighted value
                vVal += Vf[vFaces[j]] * vD;
                // update sum of distances
                dists += vD;
              }
              // average
              vVal /= dists;
              mFv[i] = vVal;
              }
              );

            Vv = mFv.Values;

          }else{

            System.Threading.Tasks.Parallel.ForEach(vInd, i =>
              {
              // standard average calculation
              int[] vFaces = M.Vertices.GetVertexFaces(i);
              double vVal = 0;
              for (int j = 0; j < vFaces.Length; j++){
                vVal += Vf[vFaces[j]];
              }
              // average
              vVal /= vFaces.Length;
              mFv[i] = vVal;
              }
              );

            Vv = mFv.Values;
          }
        }
      }
    }
# ---------- f_mf2vval: C# additional code ----------
  void initComp(bool m){
    Component.Name = "Mesh Faces to Vertices values";
    Component.NickName = "f_MF2VVal";
    Component.Description = "Converts per-face into per-vertex values";
    Component.Message = m ? "weighted" : "simple";
    Component.Params.Input[0].Name = "Mesh";
    Component.Params.Input[0].Description = "Input Mesh";
    Component.Params.Input[1].Name = "Values per faces";
    Component.Params.Input[1].Description = "List of values (one for each face)";
    Component.Params.Input[2].Name = "Method";
    Component.Params.Input[2].Description = "calculation method:\nsimple or weighted average";
    Component.Params.Output[0].Name = "Values per vertices";
    Component.Params.Output[0].Description = "Values distributed per vertices";
  }


  public Point3d getFaceCenter(Mesh M, int fInd){
    MeshFace f = M.Faces[fInd];
    Point3d c = new Point3d();
    if (f.IsValid(M.Vertices.Count)){
      c = Point3d.Add(c, (Point3d) M.Vertices[f.A]);
      c = Point3d.Add(c, (Point3d) M.Vertices[f.B]);
      c = Point3d.Add(c, (Point3d) M.Vertices[f.C]);
      if (f.IsQuad){
        c = Point3d.Add(c, (Point3d) M.Vertices[f.D]);
      }
    }
    c /= f.IsQuad ? 4 : 3;
    return c;
  }
# ---------- end f_mf2vval ----------
f_mv2fval = MeshVertexToFaceValues(M=cluster, Vv=f_mf2vval)  # -> Vf; inputs M: Mesh, Vv: list of Double, m: Boolean
#   port m: calculation method: simple or weighted average
# ---------- f_mv2fval: C# ----------
                                                                                                                                /*
    froGH - a sparse collection of (in)utilities for Grasshopper

    Convert per-Vertex values into per-Face values

    parallelization occurs after 1000 elements

    code by Alessio Erioli

    froGH by Co-de-iT is licensed under a Creative Commons Attribution 4.0 International License.
    http://creativecommons.org/licenses/by/4.0/

    */
    initComp(m);
    int pThres = 1000; // parallelization threshold

    if (M != null && Vv.Count > 0){
      if (Vv.Count == M.Vertices.Count){

        if (Vv.Count < pThres){ // non-parallel calculation

          List<double> faceVal = new List<double>();

          if(m){ //weighted average
            for (int i = 0; i < M.Faces.Count; i++){
              faceVal.Add(v2FaceWVal(M, Vv, i));
            }

          }else{ // simple average

            for (int i = 0; i < M.Faces.Count; i++){
              faceVal.Add(v2FaceVal(M, Vv, i));

            }
          }
          Vf = faceVal;


        }else{ // parallel calculation

          var mVv = new System.Collections.Concurrent.ConcurrentDictionary<int, double>(Environment.ProcessorCount, Vv.Count);
          List<int> fInd = new List<int>();
          for(int i = 0; i < M.Faces.Count; i++){
            fInd.Add(i);
          }
          foreach(int i in fInd) mVv[i] = 0; // initialise dictionary

          if(m){

            System.Threading.Tasks.Parallel.ForEach(fInd, i =>
              {
              mVv[i] = v2FaceWVal(M, Vv, i); //save your output here
              }
              );

          }else{

            System.Threading.Tasks.Parallel.ForEach(fInd, i =>
              {
              mVv[i] = v2FaceVal(M, Vv, i); //save your output here
              }
              );
          }

          Vf = mVv.Values;

        }
      }
    }
# ---------- f_mv2fval: C# additional code ----------
  void initComp(bool m){
    Component.Name = "Mesh Vertex to Face values";
    Component.NickName = "f_MV2FVal";
    Component.Description = "Converts per-vertex into per-face values";
    Component.Message = m ? "weighted" : "simple";
    Component.Params.Input[0].Name = "Mesh";
    Component.Params.Input[0].Description = "Input Mesh";
    Component.Params.Input[1].Name = "Values per vertices";
    Component.Params.Input[1].Description = "List of values (one for each vertex)";
    Component.Params.Input[2].Name = "Method";
    Component.Params.Input[2].Description = "calculation method:\nsimple or weighted average";
    Component.Params.Output[0].Name = "Values per face";
    Component.Params.Output[0].Description = "Values distributed per face";
  }

  public double v2FaceVal(Mesh M, List<double> Vv, int i){
    double fV = 0;
    int count = 0;
    MeshFace f = M.Faces.GetFace(i);
    if (f.IsValid(M.Vertices.Count)){
      fV += Vv[f.A];
      fV += Vv[f.B];
      fV += Vv[f.C];
      count = 3;
      if (f.IsQuad){
        fV += Vv[f.D];
        count = 4;
      }
      fV /= count;
    }
    return fV;
  }

  public double v2FaceWVal(Mesh M, List<double> Vv, int i){
    double fV = 0, fDist = 0, dists = 0;

    MeshFace f = M.Faces.GetFace(i);
    if (f.IsValid(M.Vertices.Count)){
      Point3d fc = getFaceCenter(M, i);
      fDist = fc.DistanceTo(M.Vertices[f.A]);
      dists += fDist;
      fV += Vv[f.A] * fDist;
      fDist = fc.DistanceTo(M.Vertices[f.B]);
      dists += fDist;
      fV += Vv[f.B] * fDist;
      fDist = fc.DistanceTo(M.Vertices[f.C]);
      dists += fDist;
      fV += Vv[f.C] * fDist;
      if (f.IsQuad){
        fDist = fc.DistanceTo(M.Vertices[f.D]);
        dists += fDist;
        fV += Vv[f.D] * fDist;
      }
      fV /= dists;
    }
    return fV;
  }

  public Point3d getFaceCenter(Mesh M, int fInd){
    MeshFace f = M.Faces[fInd];
    Point3d c = new Point3d();
    if (f.IsValid(M.Vertices.Count)){
      c = Point3d.Add(c, (Point3d) M.Vertices[f.A]);
      c = Point3d.Add(c, (Point3d) M.Vertices[f.B]);
      c = Point3d.Add(c, (Point3d) M.Vertices[f.C]);
      if (f.IsQuad){
        c = Point3d.Add(c, (Point3d) M.Vertices[f.D]);
      }
    }
    c /= f.IsQuad ? 4 : 3;
    return c;
  }
# ---------- end f_mv2fval ----------

# ---- group: use orange peel for isotopo subdivision / attractor points
pt = Point([Point(9.975824308, 2.908071531, 0), Point(7.08351242, 9.57959945, 0), Point(2.746459823, 3.478615204, 0)])

# ----
filter = StreamFilter(Gate=triangulate_mesh, Stream0=num, Stream1=f_mv2fval)
# <title>
# 
# <description>
# 
# code by <author>
# 
# v <version>
# 
# © Co-de-iT 2018 _ Creative Commons Attribution-NonCommercial-ShareAlike 4.0 International License
filter_2 = StreamFilter(Gate=triangulate_mesh, Stream0=mesh_2, Stream1=cluster)
weldvertices = MeshWeldVertices(Mesh=filter_2, Tolerance=0.01)  # -> RuntimeMessage, Mesh
flip = MeshFlip(Mesh=weldvertices.Mesh)
mesh_3 = Mesh(flip)

# ---- group: use orange peel for isotopo subdivision
# info on Ivy & display
mesh_4 = Mesh(mesh_3)
demesh = DeconstructMesh(Mesh=mesh_4)  # -> Vertices, Faces, Colours, Normals
cp = ClosestPoint(Point=pt, Cloud=demesh.Vertices)  # -> ClosestPoint, CPIndex, Distance
mgraph = MeshGraph(mesh_3, EnhancedType=0, MeshView=False, NodeGeoView=False)
edges = GraphEdges(MeshGraph=mgraph)  # -> MeshId, GraphEdge, flatten(TopoEdge), flatten(Weight), Nodes, Angle, Bend
ope = OrangePEELEdges(MeshGraph=mgraph, StartVertices=cp.CPIndex)
replace = ReplaceItems(List=edges.Weight, Item=Slider(1, range=0..1), Indices=ope, Wrap=False)
cedgeweight = CustomEdgeWeight(MeshGraph=mgraph, Weights=replace)
dom = ConstructDomain(DomainStart=0, DomainEnd=Slider(0.955, range=0..1))
mstkv = MSTKruskalValence(MeshGraph=cedgeweight, WeightLimit=dom, Valence=Slider(2, range=0..10), Size=Slider(500, range=0..1000))

# ----
percent = Slider(0.229, range=0..1)
facen = FaceNormals(Mesh=mesh_3)  # -> Centers, Normals
lng = ListLength(List=facen.Centers)  # -> expr("x-1", Length)

# ---- group: generate mesh graph
# this is the mesh dual graph - connectivity graph
grphmsh = GraphFromMesh(InputMesh=mesh_3)

# ----
multiplication = Multiplication(A=lng, B=percent)

# ---- group: midpoint distance weights
mdistweight = FaceMidpointDistanceEdgeWeight(MeshGraph=grphmsh)

# ----
cfaceweight = CustomFaceWeight(MeshGraph=grphmsh, Weights=filter)

# ---- group: face angles weight
faweight = FaceAngleEdgeWeight(MeshGraph=grphmsh)

# ---- group: face size weight
fsfaceweight = FaceSizeNodeMeshFaceWeight(MeshGraph=grphmsh)

# ----
int = Integer(multiplication)

# ---- group: generate spanning tree from graph
mstk = MSTKruskal(MeshGraph=cfaceweight)
mstd = MSTDjikstra(MeshGraph=cfaceweight, StartFace=int)
dfsedge = DFSEdgeWeight(MeshGraph=cfaceweight, StartFace=int)

# ---- group: visualize face center
item = ListItem(List=facen.Centers, Index=int, Wrap=True)

# ----
mesh_5 = Mesh(mesh_3)
mgraph_2 = MeshGraph(mstkv, EnhancedType=0, MeshView=False, NodeGeoView=False)

# ---- group: all mesh edges in topological order
c_script = CSharpScript(M=mesh_5)  # -> E; inputs M: Mesh
# ---------- c_script: C# ----------
    if (M == null) return;
    List<Line> edgeLines = new List<Line>(M.TopologyEdges.Count);
    for(int i = 0; i < M.TopologyEdges.Count; i++) edgeLines.Add(M.TopologyEdges.EdgeLine(i));
    E = edgeLines;
# ---------- end c_script ----------

# ----
# there is a mistake here:
# 
# Id pop up says id contains the number Id (index) of the corresponding mesh faces (which does not make sense). Instead, it is the index of the corresponding mesh (topological) EDGES
edges_2 = GraphEdges(MeshGraph=mgraph_2)  # -> MeshId, GraphEdge, TopoEdge, Weight, Nodes, Angle, Bend
panel = Panel(c_script)
cset = CreateSet(List=flatten(edges_2.MeshId))  # -> Set, Map
f_mebyf = EdgesByFace(M=mesh_5)  # -> i, E; inputs M: Mesh
# ---------- f_mebyf: C# ----------
    /*
    froGH - a sparse collection of (in)utilities for Grasshopper

    Map Mesh Edges by Face

    code by Alessio Erioli

    froGH by Co-de-iT is licensed under a Creative Commons Attribution 4.0 International License.
    http://creativecommons.org/licenses/by/4.0/

    */

    initComp();


    if (M != null){
      DataTree<Line> edges = new DataTree<Line>();
      DataTree<int> edgeInd = new DataTree<int>();
      GH_Path p;
      int[] edgesFInd;
      for (int k = 0; k < M.Faces.Count; k++){
        p = new GH_Path(k);
        edgesFInd = M.TopologyEdges.GetEdgesForFace(k);
        edgeInd.AddRange(edgesFInd, p);
        for (int j = 0; j < edgesFInd.Length; j++){
          edges.Add(M.TopologyEdges.EdgeLine(edgesFInd[j]), p);
        }
      }
      i = edgeInd;
      E = edges;
    }
# ---------- f_mebyf: C# additional code ----------
  void initComp(){
    Component.Name = "Edges by Face";
    Component.NickName = "f_MEbyF";
    Component.Description = "Outputs mesh edges (as lines and indexes) sorted by face";
    Component.Params.Input[0].Name = "Mesh";
    Component.Params.Input[0].Description = "Input Mesh";
    Component.Params.Output[0].Name = "Edges indexes";
    Component.Params.Output[0].Description = "Edges indexes sorted by face";
    Component.Params.Output[1].Name = "Edge lines";
    Component.Params.Output[1].Description = "Edge lines sorted by face";
  }
# ---------- end f_mebyf ----------
intersection = SetIntersection(SetA=f_mebyf.i, SetB=cset.Set)
difference = SetDifference(SetA=f_mebyf.i, SetB=cset.Set)
mesh_connected_edges_by_face = Panel(intersection)
remaining_edges_by_face = Panel(difference)

# ---- group: faces centers and normals
facen_2 = FaceNormals(Mesh=mesh_5)  # -> graft(Centers), graft(Normals)

# ---- group: remaining edges
c_script_2 = CSharpScript(M=mesh_5, i=difference)  # -> out, E; inputs M: Mesh
# ---------- c_script_2: C# ----------
    if (M == null || i == null || (int) i >= M.TopologyEdges.Count) return;

    E = M.TopologyEdges.EdgeLine((int) i);
# ---------- end c_script_2 ----------

# ---- group: edges interesed in graph sorted by mesh face
c_script_3 = CSharpScript(M=mesh_5, i=intersection)  # -> out, E; inputs M: Mesh; same code as c_script_2

# ---- group: attractor for height (just for demonstration)
pt_2 = Point([Point(-1.710163166, -14.14691698, 0), Point(5.3465951, -7.118636667, 0)])
meshcp = MeshClosestPoint(Point=pt_2, Mesh=mesh_5)  # -> Point, Index, Parameter
dist = Distance(PointA=facen_2.Centers, PointB=meshcp.Point)
addition = Addition(A=dist, B="0.001")
one_over_x = OneOverX(Value=addition)
sqrt = SquareRoot(Value=one_over_x)
avr = Average(Input=sqrt)
sqrt_2 = SquareRoot(Value=avr)
num_2 = Number(sqrt_2)
bnd = Bounds(Numbers=flatten(num_2))
remap = RemapNumbers(Value=num_2, Source=bnd, Target=Domain(0, 1))  # -> Mapped, Clipped

# ---- group: per-face values from Millipede
num_3 = Number(graft(filter))

# ---- group: displace face centers
max_displace = Slider(2.024, range=0..3)
min_displace = Slider(0.01, range=0..10)
num_4 = Number(num_3)
bnd_2 = Bounds(Numbers=flatten(num_4))
dom_2 = ConstructDomain(DomainStart=min_displace, DomainEnd=max_displace)
remap_2 = RemapNumbers(Value=num_4, Source=bnd_2, Target=dom_2)  # -> Mapped, Clipped
amp = Amplitude(Vector=facen_2.Normals, Amplitude=remap_2.Mapped)

# ---- group: edge parameters
structure_thinning = Slider(0.4, range=0.001..0.499)
subtraction = Subtraction(A="1", B=structure_thinning)
merge = Merge(Data1="0", Data2=structure_thinning, Data3=".5", Data4=subtraction, Data5="1")

# ---- group: displace face centers / displaced face centers
move = Move(Geometry=facen_2.Centers, Motion=amp)  # -> Geometry, Transform

# ---- group: graph edges / faces connected to an edge
f_mecf = EdgeConnectedFaces(M=mesh_5, i=intersection)  # -> E, simplify(F); inputs M: Mesh, i: Int32
# ---------- f_mecf: C# ----------
     /*
    froGH - a sparse collection of (in)utilities for Grasshopper

    Mesh Faces connected to a specific Edge

    code by Alessio Erioli

    froGH by Co-de-iT is licensed under a Creative Commons Attribution 4.0 International License.
    http://creativecommons.org/licenses/by/4.0/

    */

    initComp();

    if (M != null && i < M.TopologyEdges.Count){
      E = M.TopologyEdges.EdgeLine(i);

      F = M.TopologyEdges.GetConnectedFaces(i);

    }
# ---------- f_mecf: C# additional code ----------
  void initComp(){
    Component.Name = "Edge connected faces";
    Component.NickName = "f_MEcF";
    Component.Description = "Gets indexes of connected faces to a specific edge";
    Component.Params.Input[0].Name = "Mesh";
    Component.Params.Input[0].Description = "Input Mesh";
    Component.Params.Input[1].Name = "Egde index";
    Component.Params.Input[1].Description = "index of edge to sample";
    Component.Params.Output[0].Name = "Edge line";
    Component.Params.Output[0].Description = "Selected Edge as line";
    Component.Params.Output[1].Name = "Face indexes";
    Component.Params.Output[1].Description = "Indexes of faces shared by selected edge";
  }
# ---------- end f_mecf ----------

# ---- group: graph edges / displaced graph edge midpoints
item_2 = ListItem(List=flatten(move.Geometry), Index=f_mecf.F, Wrap=True)
avr_2 = Average(Input=item_2)

# ----
multiplication_2 = Multiplication(A=structure_thinning, B="2")
swatch = ColourSwatch(SwatchColor=RGB(255, 0, 0))
swatch_2 = ColourSwatch(SwatchColor=RGB(255, 255, 255))
swatch_3 = ColourSwatch(SwatchColor=RGB(255, 255, 255))
merge_2 = Merge(
    Data1=swatch_2,
    Data2=swatch_2,
    Data3=swatch_2,
    Data4=swatch_2,
    Data5=swatch_3,
    Data6=swatch_3,
    Data7=swatch_3,
    Data8=swatch_3,
    Data9=swatch)
merge_3 = Merge(
    Data1=swatch_2,
    Data2=swatch_3,
    Data3=swatch,
    Data4=swatch_3,
    Data5=swatch_2,
    Data6=swatch_3,
    Data7=swatch,
    Data8=swatch_3,
    Data9=swatch)

# ----
# these are also the indexes of the faces shared by each edge interested by the graph
mgraph_3 = MeshGraph(mstk, EnhancedType=0, MeshView=False, NodeGeoView=False)
number_slider_2 = Slider(0, range=0..10)
mgraph_4 = MeshGraph(mgraph_2, EnhancedType=0, MeshView=False, NodeGeoView=False)
mesh_6 = Mesh(mesh_5)
edges_3 = GraphEdges(MeshGraph=mgraph_4)  # -> MeshId, GraphEdge, TopoEdge, Weight, Nodes, Angle, Bend
merge_4 = Merge(
    Data1=ColourSwatch(SwatchColor=RGB(255, 255, 255)),
    Data2=ColourSwatch(SwatchColor=RGB(255, 0, 0)),
    Data3=ColourSwatch(SwatchColor=RGB(0, 55, 255)))

# ----
# info on nodes
number_slider_3 = Slider(0.139, range=0..1)
nodes = GraphNodes(MeshGraph=mgraph_3)  # -> MeshId, Point, Weight, Edges, Neighbors, Depth, NodeObject
nodes_id_faces_id = Panel(nodes.MeshId)
graph_face_neighbors = Panel(nodes.Neighbors)
node_depth_steps_from_leaf = Panel(nodes.Depth)
graph_edges_id_connecting_to_the_node = Panel(nodes.Edges)

# ----
# info on graph edges
edges_4 = GraphEdges(MeshGraph=mgraph_3)  # -> MeshId, GraphEdge, TopoEdge, Weight, Nodes, Angle, Bend
graph_topology_edge = Panel(edges_4.GraphEdge)
mesh_topology_edge_index = Panel(edges_4.MeshId)
mesh_edges_affected_by_graph = Panel(edges_4.TopoEdge)
nodes_id_mesh_faces_id_connected_by_each = Panel(edges_4.Nodes)  # "nodes id (mesh faces id) connected by each graph polyline"
angle_between_faces = Panel(edges_4.Angle)
bend_type_1_flat_2_convex_3_concave = Panel(edges_4.Bend)
edge_weights = Panel(edges_4.Weight)

# ---- group: mesh face index/node index
tag = TextTag3D(
    Location=nodes.Point,
    Text=nodes.MeshId,
    Size=number_slider_3,
    Colour=ColourSwatch(SwatchColor=RGB(0, 0, 0)),
    Justification=5)

# ---- group: node weights
tag_2 = TextTag3D(Location=nodes.Point, Text=nodes.Weight, Size=number_slider_3, Justification=5)

# ---- group: topology edges lines
crv = Curve(edges_4.TopoEdge)

# ----
subtraction_2 = Subtraction(A=edges_4.Bend, B="1")
item_3 = ListItem(List=merge_4, Index=subtraction_2, Wrap=True)
previewlw = CustomPreviewLineweights(Geometry=crv, Shader=item_3, Thickness=Slider(4, range=1..5), Absolute=False)

# ---- group: coresponding topology edge index
f_sbpath = SerialBranchPath(T=edges_3.MeshId, i=number_slider_2)  # -> P, D; inputs T: tree, i: Int32
# ---------- f_sbpath: C# ----------
                                            /*
    froGH - a sparse collection of (in)utilities for Grasshopper

    Serial Branch Path
    code by Alessio Erioli

    froGH by Co-de-iT is licensed under a Creative Commons Attribution 4.0 International License.
    http://creativecommons.org/licenses/by/4.0/

    */

    initComp();


    if (T.BranchCount > 0){
      int ind = i % T.BranchCount;
      P = T.Path(ind);
      D = T.Branches[ind];
    }
# ---------- f_sbpath: C# additional code ----------
  void initComp(){
    Component.Name = "Serial Branch Path";
    Component.NickName = "f_SBPath";
    Component.Description = "Retrieves the data tree path and data for a specific branch serial index";
    Component.Params.Input[0].Name = "Tree";
    Component.Params.Input[0].Description = "the data tree";
    Component.Params.Input[1].Name = "index";
    Component.Params.Input[1].Description = "serial index of branch to sample";
    Component.Params.Output[0].Name = "Path";
    Component.Params.Output[0].Description = "the tree branch path";
    Component.Params.Output[1].Name = "Data";
    Component.Params.Output[1].Description = "the tree branch content";
  }
# ---------- end f_sbpath ----------

# ---- group: topology edge index
curvepoint = PointOnCurve(edges_3.GraphEdge, parameter=0.5)
tag_3 = TextTag3D(
    Location=curvepoint,
    Text=edges_3.MeshId,
    Size=Slider(0.084, range=0..1),
    Colour=ColourSwatch(SwatchColor=RGB(255, 255, 255)),
    Justification=5)

# ---- group: extract edge line by topology edge index
c_script_4 = CSharpScript(M=mesh_6, i=f_sbpath.D)  # -> out, E; inputs M: Mesh, i: Int32
# ---------- c_script_4: C# ----------
    if (M == null || i >= M.TopologyEdges.Count) return;
      E = M.TopologyEdges.EdgeLine(i);
# ---------- end c_script_4 ----------
crv_2 = Curve(c_script_4.E)

# ---- group: topology edge
f_sbpath_2 = SerialBranchPath(T=edges_3.GraphEdge, i=number_slider_2)  # -> P, D; inputs T: tree, i: Int32; same code as f_sbpath
crv_3 = Curve(f_sbpath_2.D)

# ---- group: extract edge line by topology edge index
c_script_5 = CSharpScript(M=mesh_6, i=edges_3.MeshId)  # -> out, E; inputs M: Mesh, i: Int32; same code as c_script_4

# ---- group: reproducing the graph with custom height
number_slider_4 = Slider(0, range=0..2)
facen_3 = FaceNormals(Mesh=mesh_6)  # -> Centers, Normals
curvepoint_2 = PointOnCurve(c_script_5.E, parameter=0.5)
amp_2 = Amplitude(Vector=facen_3.Normals, Amplitude=number_slider_4)
move_2 = Move(Geometry=facen_3.Centers, Motion=amp_2)  # -> Geometry, Transform
item_4 = ListItem(List=facen_3.Normals, Index=edges_3.Nodes, Wrap=True)
item_5 = ListItem(List=move_2.Geometry, Index=edges_3.Nodes, Wrap=True)
avr_3 = Average(Input=item_4)
amp_3 = Amplitude(Vector=avr_3, Amplitude=number_slider_4)
move_3 = Move(Geometry=curvepoint_2, Motion=amp_3)  # -> Geometry, Transform
ins = InsertItems(List=item_5, Item=move_3.Geometry, Indices="1", Wrap=True)
pline = PolyLine(Vertices=ins, Closed=False)

# ---- group: other edges
clean = CleanTree(RemoveNulls=True, RemoveInvalid=True, RemoveEmpty=False, Tree=c_script_2.E)
lng_2 = ListLength(List=clean)
eval = EvaluateCurve(Curve=reparameterize(simplify(graft(c_script_2.E))), Parameter=merge)  # -> Point, Tangent, Angle
item_6 = ListItem(List=eval.Point, Index=0, Wrap=True)  # -> Item, Item1, Item2, Item3, Item4
num_5 = Number(multiplication_2)
subtraction_3 = Subtraction(A="1", B=num_5)
panel_2 = Panel("""T{0;5;1}
Q{1;5;6;2}
T{5;8;6}
T{4;3;7}
Q{2;6;7;3}
T{7;6;8}""")

# ---- group: other edges / face centers
dup = DuplicateData(Data=facen_2.Centers, Number=lng_2, Order=True)  # -> simplify(graft(Data))

# ---- group: other edges / displaced face centers
dup_2 = DuplicateData(Data=move.Geometry, Number=lng_2, Order=True)  # -> simplify(graft(Data))

# ---- group: other edges / face normals (not used here)
dup_3 = DuplicateData(Data=facen_2.Normals, Number=lng_2, Order=True)  # -> simplify(graft(Data)); disabled

# ---- group: graph edges
# uses the average point between neighbour faces
lng_3 = ListLength(List=c_script_3.E)
eval_2 = EvaluateCurve(Curve=reparameterize(simplify(graft(c_script_3.E))), Parameter=merge)  # -> Point, Tangent, Angle
item_7 = ListItem(List=eval_2.Point, Index=0, Wrap=True)  # -> Item, Item1, Item2, Item3, Item4
num_6 = Number(multiplication_2)
subtraction_4 = Subtraction(A="1", B=num_6)
panel_3 = Panel("""T{0;5;1}
Q{1;5;6;2}
T{5;8;6}
T{4;3;7}
Q{2;6;7;3}
T{7;6;8}""")

# ---- group: graph edges / face centers
dup_4 = DuplicateData(Data=facen_2.Centers, Number=lng_3, Order=True)  # -> simplify(graft(Data))

# ---- group: graph edges / displaced face centers
dup_5 = DuplicateData(Data=move.Geometry, Number=lng_3, Order=True)  # -> simplify(graft(Data))

# ---- group: graph edges / face normals (not used here)
dup_6 = DuplicateData(Data=facen_2.Normals, Number=lng_3, Order=True)  # -> simplify(graft(Data)); disabled

# ---- group: graph edges (continued)
merge_5 = Merge(Data1=dup_4, Data2=item_7.Item)
merge_6 = Merge(Data1=dup_5, Data2=avr_2)
merge_7 = Merge(Data1=dup_4, Data2=item_7.Item4)
interp = InterpolateData(Data=merge_5, Parameter=subtraction_4, Interpolation=2)
interp_2 = InterpolateData(Data=merge_6, Parameter=subtraction_4, Interpolation=2)
interp_3 = InterpolateData(Data=merge_7, Parameter=subtraction_4, Interpolation=2)
merge_8 = Merge(
    Data1=item_7.Item,
    Data2=item_7.Item1,
    Data3=avr_2,
    Data4=item_7.Item3,
    Data5=item_7.Item4,
    Data6=interp,
    Data7=interp_2,
    Data8=interp_3,
    Data9=dup_5)
conmesh = ConstructMesh(Vertices=merge_8, Faces=panel_3, Colours=merge_3)

# ---- group: other edges (continued)
merge_9 = Merge(Data1=dup, Data2=item_6.Item)
merge_10 = Merge(Data1=dup, Data2=item_6.Item2)
merge_11 = Merge(Data1=dup, Data2=item_6.Item4)

# ---- group: other edges / no problems if they're red
interp_4 = InterpolateData(Data=merge_9, Parameter=subtraction_3, Interpolation=2)
interp_5 = InterpolateData(Data=merge_10, Parameter=subtraction_3, Interpolation=2)
interp_6 = InterpolateData(Data=merge_11, Parameter=subtraction_3, Interpolation=2)

# ---- group: other edges (continued)
merge_12 = Merge(
    Data1=item_6.Item,
    Data2=item_6.Item1,
    Data3=item_6.Item2,
    Data4=item_6.Item3,
    Data5=item_6.Item4,
    Data6=interp_4,
    Data7=interp_5,
    Data8=interp_6,
    Data9=dup_2)
clean_2 = CleanTree(RemoveNulls=True, RemoveInvalid=True, RemoveEmpty="true", Tree=merge_12)
conmesh_2 = ConstructMesh(Vertices=clean_2, Faces=panel_2, Colours=merge_2)

# ----
panel_4 = Panel(clean_2)
wbjoin = WeaverbirdsJoinMeshesAndWeld(Mesh=flatten([conmesh, conmesh_2]), Weld=True)

# ==== cluster Cluster
mesh = ClusterInput()  # Quad mesh to triangulate
tri_citeria = ClusterInput()  # Triangulation criteria: 0 shortest diagonal, 1 longest diagonal
demesh = DeconstructMesh(Mesh=mesh)  # -> Vertices, Faces, Colours, Normals
deface = DeconstructFace(Face=graft(demesh.Faces))  # -> CornerA, CornerB, CornerC, CornerD
merge = Merge(Data1=deface.CornerA, Data2=deface.CornerB, Data3=deface.CornerC, Data4=deface.CornerD)
item = ListItem(List=demesh.Vertices, Index=merge, Wrap=True)  # -> simplify(Item)
panel = Panel("""0
1""")
panel_2 = Panel("""1
0""")
item_2 = ListItem(List=item, Index=0, Wrap=True)  # -> Item, Item1, Item2, Item3
filter = StreamFilter(Gate=tri_citeria, Stream0=panel, Stream1=panel_2)
dist = Distance(PointA=item_2.Item, PointB=item_2.Item2)
dist_2 = Distance(PointA=item_2.Item1, PointB=item_2.Item3)
merge_2 = Merge(Data1=dist, Data2=dist_2)
panel_3 = Panel("""1
2
0
3
0
2""")
panel_4 = Panel("""0
1
3
2
3
1""")
sort = SortList(Keys=merge_2, ValuesA=filter)  # -> Keys, ValuesA
item_3 = ListItem(List=sort.ValuesA, Index=0, Wrap=True)
weave = Weave(Pattern=item_3, Stream0=panel_4, Stream1=panel_3, NullGaps=False)
item_4 = ListItem(List=merge, Index=weave, Wrap=True)
partition = PartitionList(List=item_4, Size="3")
c_script = CSharpScript(F=partition)  # -> out, flatten(A); inputs F: list of String
# ---------- c_script: C# ----------
    String face = "";
    
    face += "T{" + F[0] + ";" + F[1] + ";" + F[2] + "}";
    A = face;
# ---------- end c_script ----------
conmesh = ConstructMesh(Vertices=demesh.Vertices, Faces=c_script.A)
mesh_2 = ClusterOutput(conmesh)  # Triangulated Mesh
