# Grasshopper definition 00_volume_custom field.gh (Grasshopper 1.0.5)
# Copyright: Co-de-iT
# plug-ins: Pufferfish, CurlNoise, Human

field_curves = ValueList({"random lines": 0, "predefined-single": 1, "predefined-lines": 2}, selected="random lines")
field_points = ValueList({"random": 0, "grid": 1}, selected="grid")
random_lines = Slider(5, range=2..15)
field_random_points = Slider(5000, range=20..5000)
power = Slider(2, range=0..5)
n_cells = Slider(25, range=10..50)

# ---- group: initial Brep volume
brep = Brep(<brep referenced from the Rhino model>)

# ---- group: initial Brep void(s)
brep_2 = Brep(<brep referenced from the Rhino model>)

# ----
bbox = BoundingBox(Content=brep, Plane=PlaneXY(0, 0, 0), UnionBox=True)  # -> Box, Box_2
smesh = SimpleMesh(Brep=brep)
smesh_2 = SimpleMesh(Brep=brep_2)
mjoin = MeshJoin(Meshes=smesh_2)
multiplication = Multiplication(A=random_lines, B="2")
# Custom Field Generation
# 
# Generate custom field
# 
# code by Alessio Erioli
# 
# v <version>
# 
# © Co-de-iT 2018 _ Creative Commons Attribution-NonCommercial-ShareAlike 4.0 International License
random_populate_mesh = CSharpScript(M=smesh, n=multiplication, s="5")  # -> Pts; inputs M: Mesh, V: Mesh, n: Int32, s: Int32
# ---------- random_populate_mesh: C# ----------
    Random r = new Random(s);
    BoundingBox b = new BoundingBox(M.Vertices.ToPoint3dArray());
    Point3d max = b.Max;
    Point3d min = b.Min;
    double x,y,z;
    int count = 0, i = 0;
    List<Point3d> pts = new List<Point3d>();
    List<Point3d> ptsOut = new List<Point3d>();

    while (count < n){

      x = b.Min.X + r.NextDouble() * (b.Max.X - b.Min.X);
      y = b.Min.Y + r.NextDouble() * (b.Max.Y - b.Min.Y);
      z = b.Min.Z + r.NextDouble() * (b.Max.Z - b.Min.Z);
      Point3d p = new Point3d(x, y, z);

      if (M.IsPointInside(p, 0.1, false) && (V == null ? true : !V.IsPointInside(p, 0.1, false))){
        pts.Add(p);
        count++;
      } else{
        ptsOut.Add(p);
      }

      i++;
    }

    Pts = pts;
    //PtsO = ptsOut;
# ---------- end random_populate_mesh ----------
split = SplitList(List=random_populate_mesh, Index=random_lines)  # -> ListA, ListB
ln = Line(StartPoint=split.ListA, EndPoint=split.ListB)  # -> flatten(Line)

# ---- group: avoid zero-length
len = Length(Curve=ln)
equals = Equality(FirstNumber=len, SecondNumber="0")  # -> Equality, Inequality

# ---- group: random field points
random_populate_mesh_2 = CSharpScript(M=smesh, n=field_random_points, s="2")  # -> graft(Pts); inputs M: Mesh, V: Mesh, n: Int32, s: Int32; same code as random_populate_mesh

# ---- group: Solid
mesh = Mesh(smesh)

# ---- group: Void
mesh_2 = Mesh(mjoin)

# ---- group: custom curves
crv = Curve(reparameterize(<curve referenced from the Rhino model>))
crv_2 = Curve(reparameterize([<curve referenced from the Rhino model> x3]))

# ---- group: random field curves
dispatch = Dispatch(List=ln, DispatchPattern=equals.Inequality)  # -> ListA, ListB

# ----
field_calculation = ValueList({"line based": 0, "Curl Noise": 1}, selected="line based")
scale = Slider(2.493, range=0..10)

# ---- group: curves (lines)
filter = StreamFilter(Gate=field_curves, Stream0=dispatch.ListA, Stream1=crv, Stream2=crv_2)

# ---- group: attractor curve
crv_3 = Curve(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)

# ----
# field lines display
swatch = ColourSwatch(SwatchColor=RGB(255, 255, 255))
previewlw = CustomPreviewLineweights(Geometry=filter, Shader=swatch, Thickness="3", Absolute=False)

multiplication_2 = Multiplication(A=scale, B="0.01")
X = UnitX(Factor=1)
Y = UnitY(Factor=1)
Z = UnitZ(Factor=1)
merge = Merge(Data1=X, Data2=Y, Data3=Z)
rev = Reverse(Vector=merge)
field_type = ValueList({"continuous": 0, "discrete": 1, "interpolated": 2}, selected="interpolated")
merge_2 = Merge(Data1=merge, Data2=rev)
vec = Vector(flatten([Vector(0.1593007876, -0.2228876714, 0.1366452508), Vector(0.1569961636, -0.2176235515, 0.1570719724), Vector(0.1530313431, -0.2040488741, 0.1806495742), Vector(0.1465665185, -0.1801046897, 0.2051383231), Vector(0.1365268831, -0.1448645526, 0.2277948288), Vector(0.1219681529, -0.09909337181, 0.2460408472)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]))
int = Integer(flatten([2, 2, 2, 2, 2, 2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]))
pt = Point(flatten([Point(-9.750253792, -24.10557437, 0), Point(-9.750253792, -24.10557437, 4.314148709), Point(-9.750253792, -24.10557437, 8.628297418), Point(-9.750253792, -24.10557437, 12.94244613), Point(-9.750253792, -24.10557437, 17.25659484), Point(-9.750253792, -24.10557437, 21.57074355)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]))

custom_subdir = Panel("GH_2_P5\data")
dir_type = ValueList({"desktop": 0, "documents": 1, "GH file path": 2, "C:": 3}, selected="GH file path")
f_pathg = PathGenerator(type=dir_type, subDir=custom_subdir)  # -> dir; inputs type: Int32, subDir: String
# ---------- f_pathg: C# ----------
                           /*
    froGH - a sparse collection of (in)utilities for Grasshopper

    Path Generator
    code by Alessio Erioli - value list generation based on code by James Ramsden

    froGH by Co-de-iT is licensed under a Creative Commons Attribution 4.0 International License.
    http://creativecommons.org/licenses/by/4.0/

    */
    initComp();


    String S = "";
    String root = "";
    String end = "\\";
    String eol = Environment.NewLine;

    // __________________ autoList part __________________

    // variable for the list
    Grasshopper.Kernel.Special.GH_ValueList vList;
    // tries to cast input as list
    try{

      // if the list is not the first parameter then change Input[0] to the corresponding value
      vList = (Grasshopper.Kernel.Special.GH_ValueList) Component.Params.Input[0].Sources[0];
      // Print("value list connected");
      // check if the list must be created
      //if (vList.NickName != "dir type"){
      if (!vList.NickName.Equals("dir type")){
        vList.ClearData();
        vList.ListItems.Clear();
        vList.NickName = "dir type";
        var item1 = new Grasshopper.Kernel.Special.GH_ValueListItem("desktop", "0");
        var item2 = new Grasshopper.Kernel.Special.GH_ValueListItem("documents", "1");
        var item3 = new Grasshopper.Kernel.Special.GH_ValueListItem("GH file path", "2");
        var item4 = new Grasshopper.Kernel.Special.GH_ValueListItem("C:", "3");
        vList.ListItems.Add(item1);
        vList.ListItems.Add(item2);
        vList.ListItems.Add(item3);
        vList.ListItems.Add(item4);

        vList.ListItems[0].Value.CastTo(out type);
      }
    }
    catch{
      // handles anything that is not a value list
    }


    switch(type){
      case 0:
        root = Environment.GetFolderPath(Environment.SpecialFolder.Desktop) + end;
        S = "Desktop";
        break;
      case 1:
        root = Environment.GetFolderPath(Environment.SpecialFolder.MyDocuments) + end;
        S = "Documents";
        break;
      case 2:
        GH_Document ghDoc = owner.OnPingDocument();

        if (ghDoc.IsFilePathDefined)
        {
          int nameLen = ghDoc.DisplayName.TrimEnd('*').Length + 3; // +3 accounts for the '.gh' extension
          int fileLen = ghDoc.FilePath.TrimEnd('*').Length;

          //F = ghDoc.DisplayName.TrimEnd('*');
          root = ghDoc.FilePath.Substring(0, fileLen - nameLen);
          //root = gh_d.FilePath;
          S = "GH File path";
        }
        else
        {
          Print("No path defined. Saving to Desktop until then");
          root = Environment.GetFolderPath(Environment.SpecialFolder.Desktop);
          S = "Desktop";
        }
        break;
      case 3:
        root = "C:" + end;
        S = root + end;
        break;
    }
    dir = root + (subDir != null ? (subDir + end) : "");
    Component.Message = S;
# ---------- f_pathg: C# additional code ----------
  void initComp(){
    Component.Name = "Path Generator";
    Component.NickName = "f_PathG";
    Component.Description = "generates a path based on local direcories such as Desktop, Documents, GH file path";
    Component.Params.Input[0].Name = "dir type";
    Component.Params.Input[0].Description = "directory type: 0 desktop, 1 documents, 2 GH file path, 3 C:\nconnect a value list for automatic list generation";
    Component.Params.Input[1].Name = "custom subdir";
    Component.Params.Input[1].Description = "(optional) custom subdirectory";
  }
# ---------- end f_pathg ----------
# export field
destination_directory = Panel(f_pathg)

# ---- group: point grid generation
boxprop = BoxProperties(Box=bbox.Box)  # -> Center, Diagonal, Area, Volume, Degeneracy
devec = DeconstructVector(Vector=boxprop.Diagonal)  # -> XComponent, YComponent, ZComponent
expression = Expression(C=boxprop.Center, D=boxprop.Diagonal, Expression="C-(D*0.5)")
max = Maximum(A=devec.XComponent, B=devec.YComponent)
max_2 = Maximum(A=max, B=devec.ZComponent)
division = Division(A=max_2, B=n_cells)
division_2 = Division(A=devec.XComponent, B=division)
division_3 = Division(A=devec.ZComponent, B=division)
division_4 = Division(A=devec.YComponent, B=division)
series = Series(Start=0, Step=division, Count=division_3)
sqgrid = Square(Plane=expression, Size=division, ExtentX=division_2, ExtentY=division_4)  # -> Cells, Points
Z_2 = UnitZ(Factor=series)
move = Move(Geometry=graft(sqgrid.Points), Motion=Z_2)  # -> flatten(Geometry), Transform
field_volume_filtering = BooleanToggle(True)

# ---- group: point grid generation / Filtered points
cluster = Cluster(points=move.Geometry, solid_volume=mesh, void=mesh_2)  # -> flatten(filtered_points)

# ---- group: point grid generation (continued)
filter_2 = StreamFilter(Gate=field_volume_filtering, Stream0=graft(move.Geometry), Stream1=graft(cluster))  # -> simplify(Stream)
lng = ListLength(List=flatten(filter_2))

# ----
n_of_field_grid_points = Panel(lng)

# ---- group: points
filter_3 = StreamFilter(Gate=field_points, Stream0=random_populate_mesh_2, Stream1=filter_2)  # -> simplify(Stream)

pt_2 = Point(flatten(filter_3))

# ----
gate = StreamGate(Stream=filter_3, Gate=field_calculation)  # -> Target0, Target1
crv_cp = CurveClosestPoint(Point=pt_2, Curve=crv_3)  # -> Point, Parameter, Distance

X_2 = UnitX(Factor=1)
lng_2 = ListLength(List=filter_3)
dup = DuplicateData(Data=X_2, Number=lng_2, Order=True)  # -> simplify(Data)

curl = CurlNoise(Points=gate.Target1, Scale=multiplication_2, Offset=Slider(1.266, range=0..10), _3D=Toggle(True))  # -> CurlVector, Colour

# ---- group: points
pt_3 = Point(flatten(filter_3))

pt_4 = Point(flatten(filter_3))

# ----
# field calculation
crv_cp_2 = CurveClosestPoint(Point=gate.Target0, Curve=filter)  # -> Point, Parameter, Distance
vec2pt = Vector2Pt(PointA=gate.Target0, PointB=crv_cp_2.Point, Unitize=True)  # -> Vector, Length
eval = EvaluateCurve(Curve=filter, Parameter=crv_cp_2.Parameter)  # -> Point, Tangent, Angle
xprod = CrossProduct(VectorA=vec2pt.Vector, VectorB=eval.Tangent, Unitize=False)  # -> Vector, Length

# ---- group: avoid division by 0
addition = Addition(A=crv_cp_2.Distance, B=Slider(0.01, range=0..1))

# ----
one_over_x = OneOverX(Value=addition)
pow = Power(A=one_over_x, B=power)
wav = WeightedAverage(Input=xprod.Vector, Weights=pow)

filter_4 = StreamFilter(Gate=field_calculation, Stream0=wav, Stream1=curl.CurlVector)

# ----
# field interpolation
# 2nd field
pdecon = Deconstruct(Point=filter_3)  # -> XComponent, YComponent, ZComponent
num = Number(pdecon.XComponent)
bnd = Bounds(Numbers=flatten(num))
dom = ConstructDomain(DomainStart=0, DomainEnd=1)
merge_3 = Merge(Data1=filter_4, Data2=dup)
remap = RemapNumbers(Value=num, Source=bnd, Target=dom)  # -> Mapped, Clipped
graph = GraphMapper(remap.Mapped, x0=0, x1=1, y0=0, y1=1, container_name="Bezier", cpx=[0, 0.8079656959, 0.8306354284, 1], cpy=[0, 0, 1, 1])
interp = InterpolateData(Data=merge_3, Parameter=graph, Interpolation=2)

cvec = ClosestVector(Reference=filter_4, Targets=merge_2, KeepLength=False)  # -> Closest, Angle
filter_5 = StreamFilter(Gate=field_type, Stream0=filter_4, Stream1=cvec.Closest, Stream2=interp)

# ---- group: vectors
vec_2 = Vector(flatten(filter_5))

# ----
# field display
unit = UnitVector(Vector=vec_2)
color = ValueList({"mono": 0, "by N dir": 1}, selected="by N dir")
filter_6 = StreamFilter(Gate=color, Stream0=ColourSwatch(SwatchColor=RGB(0, 0, 0)), Stream1=unit)
amp = Amplitude(Vector=unit, Amplitude=Slider(2.44, range=0..100))
vdisex = VectorDisplayEx(Point=pt_3, Vector=amp, Colour=filter_6, Width=2)

# ---- group: vectors
vec_3 = Vector(flatten(filter_5))

# ----
expression_2 = Expression(P=pt_4, Expression="Format(\"{0},{1},{2}\",P.x,P.y,P.z)")
expression_3 = Expression(P=vec_3, Expression="Format(\"{0},{1},{2}\",P.x,P.y,P.z)")
type = Panel("0")
expression_4 = Expression(p=expression_2, v=expression_3, t=type, Expression="Format(\"{0} {1} {2}\", p, v,t)")
file_name_extension = Panel("field.txt")
txt = Text(flatten(expression_4))
save = Button()
f_str2file = SaveStringToFile(S=txt, dir=f_pathg, file=file_name_extension, save=save)  # -> info; inputs S: list of String, dir: String, file: String, save: Boolean
# ---------- f_str2file: C# ----------
                           /*
    froGH - a sparse collection of (in)utilities for Grasshopper

    Save string to file

    code by Alessio Erioli

    froGH by Co-de-iT is licensed under a Creative Commons Attribution 4.0 International License.
    http://creativecommons.org/licenses/by/4.0/

    */

    initComp();



    if (save){
      if (!Directory.Exists(dir)) Directory.CreateDirectory(dir);

      String target = dir + file;

      System.IO.File.WriteAllLines(target, S.ToArray());
      info = "file saved as: " + target;
    } else {
      info = "press save button to save file";
    }
# ---------- f_str2file: C# additional code ----------
  void initComp(){
    Component.Name = "Save String to File";
    Component.NickName = "f_Str2File";
    Component.Description = "Saves a text sequence to a file";

    Component.Params.Input[0].Name = "String";
    Component.Params.Input[0].Description = "string to save (as List)";
    Component.Params.Input[1].Name = "directory";
    Component.Params.Input[1].Description = "directory where the string file is saved";
    Component.Params.Input[2].Name = "fileName";
    Component.Params.Input[2].Description = "file name and extension (ex: myText.txt)";
    Component.Params.Input[3].Name = "save";
    Component.Params.Input[3].Description = "activate saving - attach a button and click to save";
    Component.Params.Output[0].Name = "info";
    Component.Params.Output[0].Description = "information on the saving process";
  }
# ---------- end f_str2file ----------

# ----
# part type by scalar value
n_of_parts = Slider(3, range=1..5)
bnd_2 = Bounds(Numbers=crv_cp.Distance)
remap_2 = RemapNumbers(Value=crv_cp.Distance, Source=bnd_2, Target=Domain(0, 1))  # -> Mapped, Clipped

subtraction = Subtraction(A=n_of_parts, B="1")
multiplication_3 = Multiplication(A=remap_2.Mapped, B=subtraction)

int_2 = Integer(multiplication_3)

gradient = Gradient(LowerLimit=0, UpperLimit=subtraction, Parameter=int_2, stops=[0.0345: RGB(137, 205, 240), 0.98: RGB(14, 26, 76)])
preview = CustomPreview(Geometry=pt_2, Shader=gradient)

# ---- group: part n.
int_3 = Integer(flatten(int_2))

# ==== cluster Cluster
points = ClusterInput()  # Points
solid_volume = ClusterInput()  # Solid Volume
void = ClusterInput()  # Void
mjoin = MeshJoin(Meshes=solid_volume)
mjoin_2 = MeshJoin(Meshes=void)
minc = MeshInclusion(Mesh=mjoin, Point=points, Strict=False)
minc_2 = MeshInclusion(Mesh=mjoin_2, Point=points, Strict=False)
not = GateNot(A=minc_2)
and = GateAnd(A=minc, B=not)
dispatch = Dispatch(List=points, DispatchPattern=and)  # -> ListA, ListB
clean = CleanTree(RemoveNulls=True, RemoveInvalid=True, RemoveEmpty=True, Tree=dispatch.ListA)  # -> flatten(Tree)
pt = Point(graft(clean))
filtered_points = ClusterOutput(pt)  # FIltered Points
