# Grasshopper definition Mesh Editor_subdivisions.gh (Grasshopper 1.0.5)
# Copyright: Co-de-iT
# plug-ins: MeshEdit Components, Human, Weaverbird

flip = BooleanToggle(True)
# pipeline automatically references geometries from Rhinoceros
# you can scan using specific names (or search masks using ? and * characters) for:
# 
# . layer
# . object
# 
# You can also filter by geometry type
# 
# The component is currently searching for meshes in the "work mesh" layer
pipeline = GeometryPipeline(
    GroupByLayer=False,
    GroupByType=False,
    IncludeHidden=True,
    IncludeLocked=True,
    LayerFilter="work mesh",
    NameFilter="*",
    SublayerFiltering=False,
    TypeFilter=32)
# subdivision style
subd = ValueList({"none": 0, "Catmull Clark": 1, "Loop": 2, "Combined 1": 3, "Combined 2": 4, "Combined 3": 5}, selected="Catmull Clark")

# ----
# acquire & repair mesh geometry
mesh = Mesh(pipeline)
wbjoin = WeaverbirdsJoinMeshesAndWeld(Mesh=mesh, Weld=True)
weldvertices = MeshWeldVertices(Mesh=wbjoin, Tolerance=Slider(0.01, range=0.01..10))  # -> RuntimeMessage, Mesh
unifynormals = MeshUnifyNormals(Mesh=weldvertices.Mesh)
# Mesh Editor
# 
# Mesh editor helper - with subdivision strategies
# 
# code by Alessio Erioli
# 
# v 1.0
# 
# © Co-de-iT 2018 _ Creative Commons Attribution-NonCommercial-ShareAlike 4.0 International License
gate = StreamGate(Stream=unifynormals, Gate=flip)  # -> Target0, Target1
flip_2 = MeshFlip(Mesh=gate.Target1)
filter = StreamFilter(Gate=flip, Stream0=gate.Target0, Stream1=flip_2)

gate_2 = StreamGate(Stream=filter, Gate=subd)  # -> Target0, Target1, Target2, Target3, Target4, Target5
wbsplitquads = WeaverbirdsConstantQuadsSplitSubdivision(MeshCurves=gate_2.Target5, Level=Slider(1, range=1..3), SmoothNakedEdges=Slider(0, range=0..2))
wbsplitquads_2 = WeaverbirdsConstantQuadsSplitSubdivision(MeshCurves=gate_2.Target3, Level=Slider(1, range=1..3), SmoothNakedEdges=Slider(0, range=0..2))
wbsplitquads_3 = WeaverbirdsConstantQuadsSplitSubdivision(MeshCurves=gate_2.Target4, Level=Slider(1, range=1..3), SmoothNakedEdges=Slider(0, range=0..2))
wbloop = WeaverbirdsLoopSubdivision(MeshCurves=wbsplitquads, Level=Slider(1, range=1..3), SmoothNakedEdges=Slider(2, range=0..2))
wbcatmullclark = WeaverbirdsCatmullClarkSubdivision(MeshCurves=gate_2.Target1, Level=Slider(3, range=1..3), SmoothNakedEdges=Slider(2, range=0..2))
wbloop_2 = WeaverbirdsLoopSubdivision(MeshCurves=gate_2.Target2, Level=Slider(3, range=1..3), SmoothNakedEdges=Slider(2, range=0..2))
wbcatmullclark_2 = WeaverbirdsCatmullClarkSubdivision(MeshCurves=wbsplitquads_2, Level=Slider(2, range=1..3), SmoothNakedEdges=Slider(2, range=0..2))
wbloop_3 = WeaverbirdsLoopSubdivision(MeshCurves=wbsplitquads_3, Level=Slider(2, range=1..3), SmoothNakedEdges=Slider(2, range=0..2))
wbcatmullclark_3 = WeaverbirdsCatmullClarkSubdivision(MeshCurves=wbloop, Level=Slider(1, range=1..3), SmoothNakedEdges=Slider(2, range=0..2))
mesh_2 = Mesh(gate_2.Target0)
filter_2 = StreamFilter(
    Gate=subd,
    Stream0=mesh_2,
    Stream1=wbcatmullclark,
    Stream2=wbloop_2,
    Stream3=wbcatmullclark_2,
    Stream4=wbloop_3,
    Stream5=wbcatmullclark_3)
# bake this
mesh_3 = Mesh(filter_2)

# ----
# mesh
# naked edges
# clothed edges
# non-manifold edges
medges = MeshEdges(Mesh=mesh_3)  # -> NakedEdges, InteriorEdges, NonManifoldEdges
# display only
previewmat = CustomPreviewMaterials(Geometry=mesh_3, DiffuseColor=RGB(255, 255, 255), Transparency=Slider(0, range=0..1))
previewlw = CustomPreviewLineweights(
    Geometry=medges.NakedEdges,
    Shader=ColourSwatch(SwatchColor=RGB(204, 0, 255)),
    Thickness=Slider(3, range=0..10),
    Absolute=False)
previewlw_2 = CustomPreviewLineweights(Geometry=medges.InteriorEdges, Shader=ColourSwatch(SwatchColor=RGB(0, 0, 0)), Absolute=False)
previewlw_3 = CustomPreviewLineweights(Geometry=medges.NonManifoldEdges, Shader=ColourSwatch(SwatchColor=RGB(0, 0, 0)), Absolute=False)
