# Grasshopper definition Mesh editor.gh (Grasshopper 1.0.5)
# Copyright: Co-de-iT
# plug-ins: MeshEdit Components, Human, Weaverbird

# automatic reference
# pipeline automatically references geometries from Rhinoceros
# you can scan using specific names (or search masks using ? and * characters) for:
# 
# . layer
# . object
# 
# You can also filter by geometry type
# 
# The component is currently searching for meshes in the "work mesh" layer
pipeline = GeometryPipeline(
    GroupByLayer=False,
    GroupByType=False,
    IncludeHidden=True,
    IncludeLocked=True,
    LayerFilter="work mesh",
    NameFilter="*",
    SublayerFiltering=False,
    TypeFilter=32)
mesh = Mesh(pipeline)
flip = BooleanToggle(False)

# ----
# Join, Weld & Unify Normals
wbjoin = WeaverbirdsJoinMeshesAndWeld(Mesh=mesh, Weld=True)
weldvertices = MeshWeldVertices(Mesh=wbjoin, Tolerance=Slider(0.01, range=0.01..10))  # -> RuntimeMessage, Mesh
unifynormals = MeshUnifyNormals(Mesh=weldvertices.Mesh)

# ----
# Mesh Editor
# 
# <description>
# 
# code by Alessio Erioli
# 
# v <version>
# 
# © Co-de-iT 2018 _ Creative Commons Attribution-NonCommercial-ShareAlike 4.0 International License
panel = Panel("Flip (optional)")

gate = StreamGate(Stream=unifynormals, Gate=flip)  # -> Target0, Target1
flip_2 = MeshFlip(Mesh=gate.Target1)
filter = StreamFilter(Gate=flip, Stream0=gate.Target0, Stream1=flip_2)

# ----
# bake this
mesh_2 = Mesh(filter)

# ----
# mesh
# naked edges
# clothed edges
# non-manifold edges
medges = MeshEdges(Mesh=mesh_2)  # -> NakedEdges, InteriorEdges, NonManifoldEdges
# display only
previewmat = CustomPreviewMaterials(Geometry=mesh_2, DiffuseColor=RGB(255, 255, 255), Transparency=Slider(0, range=0..1))
previewlw = CustomPreviewLineweights(
    Geometry=medges.NakedEdges,
    Shader=ColourSwatch(SwatchColor=RGB(204, 0, 255)),
    Thickness=Slider(3, range=0..10),
    Absolute=False)
previewlw_2 = CustomPreviewLineweights(Geometry=medges.InteriorEdges, Shader=ColourSwatch(SwatchColor=RGB(0, 0, 0)), Absolute=False)
previewlw_3 = CustomPreviewLineweights(Geometry=medges.NonManifoldEdges, Shader=ColourSwatch(SwatchColor=RGB(0, 0, 0)), Absolute=False)
