# Grasshopper definition Selective mesh subdivision.gh (Grasshopper 1.0.5)
# Copyright: Co-de-iT
# plug-ins: MeshEdit Components, Weaverbird

number_slider = Slider(6, range=2..50)
srf = Surface(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)
mesh_uv = MeshSurface(Surface=srf, UCount=number_slider, VCount=number_slider, Overhang=True, Equalize=False)
tri = Triangulate(Mesh=mesh_uv)  # -> Mesh, Count
weldvertices = MeshWeldVertices(Mesh=tri.Mesh, Tolerance=0.01)  # -> RuntimeMessage, Mesh
flip = MeshFlip(Mesh=weldvertices.Mesh)

# ---- group: mesh selective subdivision
# <title>
# 
# <description>
# 
# code by <author>
# 
# v <version>
# 
# © Co-de-iT 2018 _ Creative Commons Attribution-NonCommercial-ShareAlike 4.0 International License
mesh = Mesh(flip)

# ---- group: mesh selective subdivision / randomly generated points (better if they have a criteria)
facen = FaceNormals(Mesh=mesh)  # -> Centers, Normals
genes = GenePool(Decimals=3, Maximum=1, Minimum=0, Value=[0.909, 0.241, 0.607, 0.278, 0.131])
lng = ListLength(List=facen.Centers)  # -> expr("x-1", Length)
multiplication = Multiplication(A=genes, B=lng)
int = Integer(multiplication)
item = ListItem(List=facen.Centers, Index=int, Wrap=True)

# ---- group: mesh selective subdivision (continued)
meshcp = MeshClosestPoint(Point=item, Mesh=mesh)  # -> Point, Index, Parameter

# ---- group: mesh selective subdivision / selective face subdivision
c_script = CSharpScript(M=mesh, i=meshcp.Index)  # -> A; inputs M: Mesh, i: list of Int32
# ---------- c_script: C# ----------
    int fc = M.Faces.Count;
    Mesh nf = new Mesh();
    List<int> df = new List<int>();
    Mesh newFaces = new Mesh();


    for(int j = 0; j < i.Count; j++){
      if (i[j] > fc) continue;
      // adds faces to the list of faces to cull
      df.Add(i[j]);
      nf = subdivideFace(M, i[j]);
      newFaces.Append(nf);
    }

    M.Faces.DeleteFaces(df);
    M.Append(newFaces);
    M.Weld(0.1);
    M.RebuildNormals();
    A = M;
# ---------- c_script: C# additional code ----------
  public Mesh subdivideFace(Mesh M, int i){
    Mesh nf = new Mesh();
    List<Point3f> vertices = new List<Point3f>();
    Point3f fMid = new Point3f();
    fMid += M.Vertices[M.Faces[i].A];
    vertices.Add(M.Vertices[M.Faces[i].A]);
    fMid += M.Vertices[M.Faces[i].B];
    vertices.Add(M.Vertices[M.Faces[i].B]);
    fMid += M.Vertices[M.Faces[i].C];
    vertices.Add(M.Vertices[M.Faces[i].C]);

    if (M.Faces[i].IsQuad){
      vertices.Add(M.Vertices[M.Faces[i].D]);
      fMid += M.Vertices[M.Faces[i].D];
      fMid = avg(fMid, 4);
    }else{
      fMid = avg(fMid, 3);
    }
    vertices.Add(fMid);
    nf.Vertices.AddVertices(vertices);
    for (int j = 0; j < nf.Vertices.Count - 1; j++){
      nf.Faces.AddFace(j, (j + 1) % (nf.Vertices.Count - 1), nf.Vertices.Count - 1);
    }
    return nf;
  }

 public Point3f avg(Point3f accum, int n){
    accum.X /= n;
    accum.Y /= n;
    accum.Z /= n;

    return accum;
  }
# ---------- end c_script ----------

# ---- group: mesh selective subdivision (continued)
wbloop = WeaverbirdsLoopSubdivision(MeshCurves=c_script, Level=1, SmoothNakedEdges=0)
wblaplace = WeaverbirdsLaplacianSmoothing(MeshCurves=wbloop, Level=1, SmoothNakedEdges=0, Thin=1)
