# Grasshopper definition clipping plane anim.gh (Grasshopper 1.0.5)

# import a clipping plane
# from Rhino here
animation_slider = Slider(1, range=0..1)

# ----
# move Rhino plane out of sight
plane_x_dir = Slider(0, range=-2..2)
plane_y_dir = Slider(987.13, range=-2..2000)

# ----
# geometries
geo = Geometry([<mesh referenced from the Rhino model> x4])
section_plane = ValueList({"XY": 0, "XZ": 1, "YZ": 2, "custom": 3}, selected="XY")
reverse = ValueList({"no": 0, "yes": 1}, selected="no")

# ---- group: z
pt = Point(Point(0, 0, 1))

# ---- group: y
pt_2 = Point(Point(0, 1, 0))

# ---- group: x
pt_3 = Point(Point(1, 0, 0))

# ---- group: input custom vector here
vec = Vector()

# ----
id = Guid(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)
pt_4 = Point(Point(0, 0, 0))
bbox = BoundingBox(Content=geo, Plane=PlaneXY(0, 0, 0), UnionBox=True)  # -> Box, Box_2
filter = StreamFilter(Gate=section_plane, Stream0=pt, Stream1=pt_2, Stream2=pt_3, Stream3=vec)
box = EvaluateBox(Box=bbox.Box, UParameter=0.5, VParameter=0.5, WParameter=0.5)  # -> Plane, Point, Include
rev = Reverse(Vector=filter)
filter_2 = StreamFilter(Gate=reverse, Stream0=filter, Stream1=rev)
scale = Scale(Geometry=bbox.Box, Center=box.Point, Factor=Slider(1.2, range=1..2))  # -> Geometry, Transform
pl = PlaneNormal(Origin=pt_4, ZAxis=filter_2)
box_corners = BoxCorners(Box=scale.Geometry)  # -> CornerA, CornerB, CornerC, CornerD, CornerE, CornerF, CornerG, CornerH
min = Slider(120, range=50..180)
max = Slider(158.93, range=55..190)
pdecon = Deconstruct(Point=box_corners.CornerA)  # -> XComponent, YComponent, ZComponent
pdecon_2 = Deconstruct(Point=box_corners.CornerE)  # -> XComponent, YComponent, ZComponent
pdecon_3 = Deconstruct(Point=box_corners.CornerA)  # -> XComponent, YComponent, ZComponent
pdecon_4 = Deconstruct(Point=box_corners.CornerD)  # -> XComponent, YComponent, ZComponent
pdecon_5 = Deconstruct(Point=box_corners.CornerA)  # -> XComponent, YComponent, ZComponent
pdecon_6 = Deconstruct(Point=box_corners.CornerB)  # -> XComponent, YComponent, ZComponent
dom = Domain(DomainStart=pdecon.ZComponent, DomainEnd=pdecon_2.ZComponent)
dom_2 = Domain(DomainStart=pdecon_3.YComponent, DomainEnd=pdecon_4.YComponent)
dom_3 = Domain(DomainStart=pdecon_5.XComponent, DomainEnd=pdecon_6.XComponent)
dom_4 = Domain(DomainStart=min, DomainEnd=max)
# <title>
# 
# <description>
# 
# code by <author>
# 
# v <version>
# 
# © Co-de-iT 2018 _ Creative Commons Attribution-NonCommercial-ShareAlike 4.0 International License
# easing animation
graph = GraphMapper(
    animation_slider,
    x0=0,
    x1=1,
    y0=0,
    y1=1,
    container_name="Bezier",
    cpx=[0, 0, 0.9923480749, 1],
    cpy=[0, 0.413043499, 0.593565166, 1])
pln = Plane(pl)
filter_3 = StreamFilter(Gate=section_plane, Stream0=dom, Stream1=dom_2, Stream2=dom_3, Stream3=dom_4)
remap = RemapNumbers(Value=graph, Source=Domain(0, 1), Target=filter_3)  # -> Mapped, Clipped
pdecon_7 = Deconstruct(Point=box.Point)  # -> XComponent, YComponent, ZComponent
pt_5 = ConstructPoint(XCoordinate=pdecon_7.XComponent, YCoordinate=pdecon_7.YComponent, ZCoordinate=remap.Mapped)
deplane = DeconstructPlane(Plane=pl)  # -> Origin, XAxis, YAxis, ZAxis
amp = Amplitude(Vector=deplane.XAxis, Amplitude=plane_x_dir)
amp_2 = Amplitude(Vector=deplane.YAxis, Amplitude=plane_y_dir)
addition = Addition(A=deplane.Origin, B=amp, C=amp_2)
pl_origin = PlaneOrigin(Base=pln, Origin=addition)
boxprop = BoxProperties(Box=bbox.Box)  # -> Center, Diagonal, Area, Volume, Degeneracy
devec = DeconstructVector(Vector=boxprop.Diagonal)  # -> XComponent, YComponent, ZComponent
c_script = CSharpScript(id=id, y=pl_origin)  # -> out, A; inputs id: Guid, y: Plane
# ---------- c_script: C# ----------
    Rhino.DocObjects.ObjRef obj = new Rhino.DocObjects.ObjRef(id);
    Rhino.DocObjects.ClippingPlaneObject cpObj = obj.Object() as Rhino.DocObjects.ClippingPlaneObject;
    cpObj.ClippingPlaneGeometry.Plane = y;
    cpObj.CommitChanges();
# ---------- end c_script ----------
pl_origin_2 = PlaneOrigin(Base=pl_origin, Origin=pt_5)

# ---- group: create custom symmetric interval
c_script_2 = CSharpScript(L=devec.XComponent)  # -> D; inputs L: Double
# ---------- c_script_2: C# ----------
    D = new Interval(-L * 0.5, L * 0.5);
# ---------- end c_script_2 ----------
c_script_3 = CSharpScript(L=devec.YComponent)  # -> D; inputs L: Double; same code as c_script_2

# ----
Z = UnitZ(Factor=Slider(-0.03, range=-1..0))
move = Move(Geometry=pl_origin_2, Motion=Z)  # -> Geometry, Transform
panel = Panel(c_script_3)
rectangle = Rectangle(Plane=pl_origin_2, XSize=c_script_2, YSize=c_script_3, Radius=0)  # -> Rectangle, Length
scale_2 = Scale(Geometry=rectangle.Rectangle, Center=move.Geometry, Factor=Slider(1.184, range=1..2))  # -> Geometry, Transform

# ---- group: visualize plane as planar surface
boundary = BoundarySurfaces(Edges=scale_2.Geometry)
