# Grasshopper definition interpolate mesh data.gh (Grasshopper 1.0.5)
# Copyright: Co-de-iT
# plug-ins: MeshEdit Components, Weaverbird

# ---- group: data to interpolate
num = Number([-3509756.066, -4332037.332, -4808793.655, -4516277.866, -530423.5044, -3016545.127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])

# ---- group: stress planes
pln = Plane([Plane(origin=(2.662291229, 4.169837832, 0.08343562652), x=(0.2679376117, -0.5101089539, -0.8173116244), y=(0.9199158697, -0.1166328282, 0.3743682359)), Plane(origin=(2.674428523, 4.258546948, 0.2483767383), x=(0.1332489635, -0.5414592644, -0.8301003426), y=(0.9093335049, -0.266308261, 0.3196755964)), Plane(origin=(2.622361422, 4.278149486, 0.2488002628), x=(0.1568592832, -0.5640606489, -0.8106976931), y=(0.9295033698, -0.1931171669, 0.3142121027)), Plane(origin=(2.613666594, 4.178741336, 0.0835818503), x=(0.1402390488, -0.5086190709, -0.8494937609), y=(0.9697256019, -0.1026754533, 0.221562651)), Plane(origin=(2.685076535, 4.355864167, 0.4080719724), x=(-0.2392581309, -0.4419918577, -0.8645222638), y=(-0.8617943422, 0.5068385261, -0.0206208665)), Plane(origin=(2.693947911, 4.461517096, 0.5597535446), x=(-0.2849885379, -0.4486907677, -0.8470290008), y=(-0.8321609637, 0.5543655377, -0.01367410365))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])

# ----
mesh = Mesh(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)
wbcatmullclark = WeaverBirdsCatmullClarkSubdivision(MeshCurves=mesh, Level="1", SmoothNakedEdges=1)

# ---- group: display original vectors
deplane = DeconstructPlane(Plane=pln)  # -> Origin, XAxis, YAxis, ZAxis
amp = Amplitude(Vector=deplane.XAxis, Amplitude=Slider(0.084, range=0..1))
vdisex = VectorDisplayEx(Point=deplane.Origin, Vector=amp, Colour=RGB(0, 0, 0), Width=2)

# ---- group: gradient color for data - original mesh
num_2 = Number(num)
bnd = Bounds(Numbers=flatten(num_2))
dom = ConstructDomain(DomainStart=0, DomainEnd=1)
explode = MeshExplode(Mesh=mesh, Interpolate=False)
remap = RemapNumbers(Value=num_2, Source=bnd, Target=dom)  # -> Mapped, Clipped
gradient = Gradient(LowerLimit=0, UpperLimit=1, Parameter=remap.Clipped, stops=[0.0345: RGB(137, 205, 240), 0.98: RGB(14, 26, 76)])
mcol = MeshColours(Mesh=graft(explode), Colours=graft(gradient))
mjoin = MeshJoin(Meshes=flatten(mcol))

# ----
# <title>
# 
# <description>
# 
# code by <author>
# 
# v <version>
# 
# © Co-de-iT 2018 _ Creative Commons Attribution-NonCommercial-ShareAlike 4.0 International License
facen = FaceNormals(Mesh=wbcatmullclark)  # -> Centers, Normals
facen_2 = FaceNormals(Mesh=mesh)  # -> Centers, Normals
cps = ClosestPoints(Point=facen.Centers, Cloud=facen_2.Centers, Count=Slider(4, range=0..10))  # -> ClosestPoint, CPIndex, Distance
item = ListItem(List=num, Index=cps.CPIndex, Wrap=True)
item_2 = ListItem(List=deplane.XAxis, Index=cps.CPIndex, Wrap=True)
item_3 = ListItem(List=deplane.YAxis, Index=cps.CPIndex, Wrap=True)
one_over_x = OneOverX(Value=cps.Distance)
one_over_x_2 = OneOverX(Value=cps.Distance)
one_over_x_3 = OneOverX(Value=cps.Distance)
wav = WeightedAverage(Input=item, Weights=one_over_x)  # -> flatten(ArithmeticMean)
wav_2 = WeightedAverage(Input=item_2, Weights=one_over_x_2)  # -> flatten(ArithmeticMean)
wav_3 = WeightedAverage(Input=item_3, Weights=one_over_x_3)  # -> flatten(ArithmeticMean)
pt = Point(facen.Centers)

# ---- group: display interpolated vectors
amp_2 = Amplitude(Vector=wav_2, Amplitude=Slider(0.084, range=0..1))
vdisex_2 = VectorDisplayEx(Point=pt, Vector=amp_2, Colour=RGB(0, 0, 0), Width=2)

# ---- group: gradient color for data - subdivided mesh
explode_2 = MeshExplode(Mesh=wbcatmullclark, Interpolate=False)
num_3 = Number(wav)
bnd_2 = Bounds(Numbers=flatten(num_3))
dom_2 = ConstructDomain(DomainStart=0, DomainEnd=1)
remap_2 = RemapNumbers(Value=num_3, Source=bnd_2, Target=dom_2)  # -> Mapped, Clipped
gradient_2 = Gradient(LowerLimit=0, UpperLimit=1, Parameter=remap_2.Clipped, stops=[0.0345: RGB(137, 205, 240), 0.98: RGB(14, 26, 76)])
mcol_2 = MeshColours(Mesh=graft(explode_2), Colours=graft(gradient_2))
mjoin_2 = MeshJoin(Meshes=flatten(mcol_2))

# ----
pl = ConstructPlane(Origin=pt, XAxis=wav_2, YAxis=wav_3)

# ---- group: interpolated mesh
mesh_2 = Mesh(wbcatmullclark)

# ---- group: interpolated values
num_4 = Number(wav)

# ---- group: interpolated stress planes
pln_2 = Plane(pl)
