# Grasshopper definition list interpolate.gh (Grasshopper 1.0.5)
# Copyright: Co-de-iT

series = Series(Start=0, Step=1, Count=10)
interplist = CSharpScript(V=series, i=Slider(0.25, range=0..1))  # -> E, ind; inputs V: list, i: Double
# ---------- interplist: C# ----------
    int index = (int) (i * (V.Count() - 1));
    E = V[index];
    ind = index;
# ---------- end interplist ----------
# List Interpolate
# 
# Custom component to interpolate using a normalized range (0..1) among a list of data
# 
# code by Alessio Erioli
# 
# v 0.1
# 
# © Co-de-iT 2018 _ Creative Commons Attribution-NonCommercial-ShareAlike 4.0 International License
panel = Panel(interplist.E)
panel_2 = Panel(interplist.ind)
