# Grasshopper definition sphere inversion.gh (Grasshopper 1.0.5)
# Copyright: Co-de-iT
# plug-ins: Weaverbird

number_slider = Slider(6.721, range=0..20)
mesh = Mesh(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)
demesh = DeconstructMesh(Mesh=mesh)  # -> Vertices, Faces, Colours, Normals
pt = Point(Point(0, 0, 0))
vec2pt = Vector2Pt(PointA=demesh.Vertices, PointB=pt, Unitize=False)  # -> Vector, Length
vlen = VectorLength(Vector=vec2pt.Vector)
division = Division(A=number_slider, B=vlen)
panel = Panel("3")
# <title>
# 
# <description>
# 
# code by <author>
# 
# v <version>
# 
# © Co-de-iT 2018 _ Creative Commons Attribution-NonCommercial-ShareAlike 4.0 International License
msphere = MeshSphere(Base=pt, Radius=number_slider, UCount=10, VCount=20)
pow = Power(A=division, B=Slider(1.646, range=1..3))
multiplication = Multiplication(A=vec2pt.Vector, B=pow)
conmesh = ConstructMesh(Vertices=multiplication, Faces=demesh.Faces)
wbcatmullclark = WeaverbirdsCatmullClarkSubdivision(MeshCurves=conmesh, Level=Slider(1, range=1..3), SmoothNakedEdges=1)
