# Grasshopper definition K_graph generator.gh (Grasshopper 1.0.5)
# Copyright: Co-de-iT

# ----
# 1 - set parameters
# and choose a view
text_offset_from_callout = Slider(2.071, range=1..4)
# 2 - align text to view
# 3 - bake
align_to_view = Button()
text_size = Slider(0.8, range=0.1..4)

# ---- group: mesh after
mesh = Mesh(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)

# ---- group: mesh before
mesh_2 = Mesh(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)

# ---- group: anchor points
pt = Point([Point(115.2771378, 100.5386963, 0), Point(115.1790314, 103.274826, 0), Point(116.7732544, 105.1183929, 0), Point(119.2626953, 105.1476135, 0), Point(119.3608093, 98.05082703, 0), Point(116.949852, 98.44909668, 0)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])

# ---- group: bending naked edges
crv = Curve(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)

# ----
demesh = DeconstructMesh(Mesh=mesh_2)  # -> Vertices, Faces, Colours, Normals
demesh_2 = DeconstructMesh(Mesh=mesh)  # -> Vertices, Faces, Colours, Normals
ln = Line(StartPoint=demesh.Vertices, EndPoint=demesh_2.Vertices)
len = Length(Curve=ln)
# Kangaroo Simulation setup
# 
# from basic low-poly mesh to simulated material properties
# 
# code by Alessio Erioli
# 
# v 1.0
# 
# © Co-de-iT 2018 _ Creative Commons Attribution-NonCommercial-ShareAlike 4.0 International License
medges = MeshEdges(Mesh=mesh_2)  # -> NakedEdges, InteriorEdges, NonManifoldEdges
medges_2 = MeshEdges(Mesh=mesh)  # -> NakedEdges, InteriorEdges, NonManifoldEdges
num = Number(len)
bnd = Bounds(Numbers=flatten(num))
crv_2 = Curve([medges.InteriorEdges, medges.NakedEdges])
crv_3 = Curve([medges_2.InteriorEdges, medges_2.NakedEdges])
dom = ConstructDomain(DomainStart=0, DomainEnd=1)
remap = RemapNumbers(Value=num, Source=bnd, Target=dom)  # -> Mapped, Clipped
expression = Expression(x=len, Expression="Format(\"d {0}\", round(x,2))")
vec = Vector(ln)
gradient = Gradient(LowerLimit=0, UpperLimit=1, Parameter=remap.Mapped, stops=[0.0822: RGB(0, 0, 0), 0.864: RGB(255, 0, 47)])
end = EndPoints(Curve=ln)  # -> Start, End
amp = Amplitude(Vector=vec, Amplitude=text_offset_from_callout)
merge = Merge(Data1=ColourSwatch(SwatchColor=RGB(0, 0, 0)), Data2=ColourSwatch(SwatchColor=RGB(200, 0, 0)))
move = Move(Geometry=end.End, Motion=amp)  # -> Geometry, Transform
interp = InterpolateData(Data=merge, Parameter=remap.Mapped, Interpolation=2)
preview = CustomPreview(Geometry=ln, Material=interp)  # disabled
unmod_wires = ColourSwatch(SwatchColor=RGB(105, 105, 105))
anchors = ColourSwatch(SwatchColor=RGB(255, 0, 0))
naked_edges = ColourSwatch(SwatchColor=RGB(0, 0, 0))
panel = Panel("""mesh
mesh edgelines_orig
mesh edgelines_after
lines
anchors
naked edges""")
# graph generator
f_o2cam = OrientToCamera(Pt=move.Geometry, refresh=align_to_view)  # -> P; inputs Pt: Point3d, refresh: Boolean
#   port refresh: true to refresh button: manual refresh toggle + timer: auto refresh
# ---------- f_o2cam: C# ----------
                              /*
    froGH - a sparse collection of (in)utilities for Grasshopper

    Orient to Camera
    code by Alessio Erioli

    froGH by Co-de-iT is licensed under a Creative Commons Attribution 4.0 International License.
    http://creativecommons.org/licenses/by/4.0/

    */

    initComp();

    Plane p;

    if (RhinoDoc.ActiveDoc.Views.ActiveView.ActiveViewport.GetCameraFrame(out p)){
      P = new Plane(new Point3d(Pt.X, Pt.Y, Pt.Z), p.XAxis, p.YAxis);
    }
# ---------- f_o2cam: C# additional code ----------
  void initComp(){
    Component.Name = "Orient to Camera";
    Component.NickName = "f_O2Cam";
    Component.Description = "Creates a plane on the input point aligned with current camera";
    Component.Message = RhinoDoc.ActiveDoc.Views.ActiveView.ActiveViewport.Name;
    Component.Params.Input[0].Name = "Base Point";
    Component.Params.Input[0].Description = "Base point for new plane";
    Component.Params.Input[1].Name = "Refresh";
    Component.Params.Input[1].Description = "true to refresh \nbutton: manual refresh \ntoggle + timer: auto refresh";
    Component.Params.Output[0].Name = "Plane";
    Component.Params.Output[0].Description = "Camera Aligned Plane";
  }
# ---------- end f_o2cam ----------
concat = Concatenate(FragmentA="KG_", FragmentB=panel)  # -> graft(Result)
entwine = Entwine(Branch00=mesh_2, Branch01=crv_2, Branch02=crv_3, Branch03=ln, Branch04=pt, Branch05=crv, FlattenInputs=True)
entwine_2 = Entwine(Branch01=unmod_wires, Branch02=naked_edges, Branch03=interp, Branch04=anchors, Branch05=naked_edges, FlattenInputs=True)

group = BooleanToggle(False)
bake = Button()
data_text = ColourSwatch(SwatchColor=RGB(0, 0, 0))
f_bakeatt = BakeAttributesEnhanced(obj=entwine, layer=concat, color=entwine_2, group=group, bake_iT=bake)  # -> info; inputs obj: GeometryBase, name: String, layer: String, color: Color, pWidth: Double, wires: Int32, group_n: Int32, group: Boolean, bake_iT: Boolean
#   port layer: Layer name for the object if the layer doesn't exist, it will be created
#   port bake_iT: Performs bake operation attach a button here and click to bake
# ---------- f_bakeatt: C# ----------
                                                                /*
    froGH - a sparse collection of (in)utilities for Grasshopper

    Bake Attributes ++
    Original Version Written by Giulio Piacentino - 2010 11 21 - for Grasshopper 0.8.002
    Enhanced by Co-de-iT (Alessio) - now bakes on chosen layer(s) and in groups

    froGH by Co-de-iT is licensed under a Creative Commons Attribution 4.0 International License.
    http://creativecommons.org/licenses/by/4.0/

    */

    initComp();

    if (bake_iT)
    {
      if(obj == null)
      {
        Print("No object to bake");
        return;
      }

      //Make new attribute to set name
      Rhino.DocObjects.ObjectAttributes att = new Rhino.DocObjects.ObjectAttributes();

      //Set object name
      if(!string.IsNullOrEmpty(name))
      {
        att.Name = name;
      }

      //Set color
      if(!color.IsEmpty)
      {
        att.ColorSource = Rhino.DocObjects.ObjectColorSource.ColorFromObject; //Make the color type "by object"
        att.ObjectColor = color;

        att.PlotColorSource = Rhino.DocObjects.ObjectPlotColorSource.PlotColorFromObject; //Make the plot color type "by object"
        att.PlotColor = color;
      }

      // Set group

      if(group)
      {
        doc.Groups.Add(Convert.ToString(group_n));
        att.AddToGroup(group_n);

      }

      //Set layer
      if(!string.IsNullOrEmpty(layer) && Rhino.DocObjects.Layer.IsValidName(layer))
      {
        //Get the current layer index
        Rhino.DocObjects.Tables.LayerTable layerTable = doc.Layers;
        int layerIndex = layerTable.Find(layer, true);

        if(layerIndex < 0) //This layer does not exist, we add it
        {
          Rhino.DocObjects.Layer onlayer = new Rhino.DocObjects.Layer(); //Make a new layer
          onlayer.Name = layer;

          layerIndex = layerTable.Add(onlayer); //Add the layer to the layer table
          if (layerIndex > -1) //We manged to add layer!
          {
            att.LayerIndex = layerIndex;
            Print("Added new layer to the document at position " + layerIndex + " named " + layer + ". ");
          } else
            Print("Layer did not add. Try cleaning up your layers."); //This never happened to me.
        }
        else
          att.LayerIndex = layerIndex; //We simply add to the existing layer
      }


      //Set plotweight
      if(pWidth > 0)
      {
        att.PlotWeightSource = Rhino.DocObjects.ObjectPlotWeightSource.PlotWeightFromObject;
        att.PlotWeight = pWidth;
      }


      //Set material
      bool materialByName = !string.IsNullOrEmpty(material as string);
      Rhino.Display.DisplayMaterial inMaterial = material as Rhino.Display.DisplayMaterial;
      if(material is Color)
      {
        inMaterial = new Rhino.Display.DisplayMaterial((Color) material);
      }
      if(material != null && inMaterial == null && !materialByName)
      {
        if(!(material is string))
        {
          try //We also resort to try with IConvertible
          {
            inMaterial = (Rhino.Display.DisplayMaterial) Convert.ChangeType(material, typeof(Rhino.Display.DisplayMaterial));
          }
          catch(InvalidCastException)
          {
          }
        }
      }
      if(inMaterial != null || materialByName)
      {
        string matName;

        if(!materialByName)
        {
          matName = string.Format("A:{0}-D:{1}-E:{2}-S:{3},{4}-T:{5}",
            Format(inMaterial.Ambient),
            Format(inMaterial.Diffuse),
            Format(inMaterial.Emission),
            Format(inMaterial.Specular),
            inMaterial.Shine.ToString(),
            inMaterial.Transparency.ToString()
            );
        }
        else
        {
          matName = (string) material;
        }

        int materialIndex = doc.Materials.Find(matName, true);
        if(materialIndex < 0 && !materialByName) //Material does not exist and we have its specs
        {
          materialIndex = doc.Materials.Add(); //Let's add it
          if(materialIndex > -1)
          {
            Print("Added new material at position " + materialIndex + " named \"" + matName + "\". ");
            Rhino.DocObjects.Material m = doc.Materials[materialIndex];
            m.Name = matName;
            m.AmbientColor = inMaterial.Ambient;
            m.DiffuseColor = inMaterial.Diffuse;
            m.EmissionColor = inMaterial.Emission;
            //m.ReflectionColor = no equivalent
            m.SpecularColor = inMaterial.Specular;
            m.Shine = inMaterial.Shine;
            m.Transparency = inMaterial.Transparency;
            //m.TransparentColor = no equivalent
            m.CommitChanges();

            att.MaterialSource = Rhino.DocObjects.ObjectMaterialSource.MaterialFromObject;
            att.MaterialIndex = materialIndex;
          }
          else
            Print("Material did not add. Try cleaning up your materials."); //This never happened to me.
        }
        else if(materialIndex < 0 && materialByName) //Material does not exist and we do not have its specs. We do nothing
        {
          Print("Warning: material name not found. I cannot set the source to this material name. Add a material with name: " + matName);
        }
        else
        {
          //If this material exists, we do not replace it!
          att.MaterialSource = Rhino.DocObjects.ObjectMaterialSource.MaterialFromObject;
          att.MaterialIndex = materialIndex;
        }
      }


      //Set wire density
      if(wires == -1 || wires > 0)
      {
        att.WireDensity = wires;
      }


      //Bake to the right type of object
      switch(obj.ObjectType)
      {
        case Rhino.DocObjects.ObjectType.Brep:
          doc.Objects.AddBrep(obj as Brep, att);
          break;
        case Rhino.DocObjects.ObjectType.Curve:
          doc.Objects.AddCurve(obj as Curve, att);
          break;
        case Rhino.DocObjects.ObjectType.Point:
          doc.Objects.AddPoint((obj as Rhino.Geometry.Point).Location, att);
          break;
        case Rhino.DocObjects.ObjectType.Surface:
          doc.Objects.AddSurface(obj as Surface, att);
          break;
        case Rhino.DocObjects.ObjectType.Mesh:
          doc.Objects.AddMesh(obj as Mesh, att);
          break;
        case Rhino.DocObjects.ObjectType.Extrusion:
          typeof(Rhino.DocObjects.Tables.ObjectTable).InvokeMember("AddExtrusion", BindingFlags.Instance | BindingFlags.InvokeMethod, null, doc.Objects, new object[]{obj, att});
          break;
        case Rhino.DocObjects.ObjectType.PointSet:
          doc.Objects.AddPointCloud(obj as Rhino.Geometry.PointCloud, att); //This is a speculative entry
          break;
        default:
          Print("The script does not know how to handle this type of geometry: " + obj.GetType().FullName);
          break;
      }
      Print("Added " + obj.GetType().Name);

    }
    else
    {
      Print("Inactive");
    }
    //obj_out = obj;
# ---------- f_bakeatt: C# additional code ----------
  void initComp(){

    Component.Name = "Bake Attributes Enhanced";
    Component.NickName = "f_BakeAtt++";
    Component.Description = "Bakes objects with attributes such as color, material, layer, object name, wire density. Option to bake in groups";
    Component.Params.Input[0].Name = "Object";
    Component.Params.Input[0].Description = "Object to bake";
    Component.Params.Input[1].Name = "Object name";
    Component.Params.Input[1].Description = "A custom name for the object";
    Component.Params.Input[2].Name = "Object Layer";
    Component.Params.Input[2].Description = "Layer name for the object\nif the layer doesn't exist, it will be created";
    Component.Params.Input[3].Name = "Object Color";
    Component.Params.Input[3].Description = "Color of baked object";
    Component.Params.Input[4].Name = "Print Width";
    Component.Params.Input[4].Description = "Print width";
    Component.Params.Input[5].Name = "Wire density";
    Component.Params.Input[5].Description = "Density of wires for display";
    Component.Params.Input[6].Name = "Material";
    Component.Params.Input[6].Description = "Object custom material";
    Component.Params.Input[7].Name = "Group Number";
    Component.Params.Input[7].Description = "Number of the group for the object\n(in case group option is active)";
    Component.Params.Input[8].Name = "Group Objects";
    Component.Params.Input[8].Description = "Bake objects in groups according to the group number for each object";
    Component.Params.Input[9].Name = "Bake it!";
    Component.Params.Input[9].Description = "Performs bake operation\nattach a button here and click to bake";
    Component.Params.Output[0].Name = "Info";
    Component.Params.Output[0].Description = "Info on the bake process/result";

  }

  static string Format(Color c)
  {
    return (new System.Text.StringBuilder("A")).Append(c.A.ToString()).Append("R").Append(c.R.ToString()).Append("G")
      .Append(c.G.ToString()).Append("B").Append(c.B.ToString()).ToString();
  }
# ---------- end f_bakeatt ----------

# ---- group: bake texts from here (group them)
# Align to view first!!!
# 
# create a layer
# 
# KG_text
# 
#  and bake there
tag = TextTag3D(Location=f_o2cam, Text=expression, Size=text_size, Colour=data_text, Justification="8")
