# Grasshopper definition MP_graph generator.gh (Grasshopper 1.0.5)

# ---- group: PS1
crv = Curve([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])

# ---- group: stress values
num = Number([19968279.5, 15317409.84, 18628632.02, 32382499.17, 23497890.72, 29466164.96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])

# ---- group: initial mesh
# generated diagrams: . load and support conditions with base mesh
# 
# . colored mesh with principal stress direction
# 
# . spheres of stress value on wireframe mesh
mesh = Mesh(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)

# ---- group: loads
brep = Brep(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)

# ---- group: supports
brep_2 = Brep(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)

# ---- group: b/w mesh
mesh_2 = Mesh(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)

# ---- group: PS2
crv_2 = Curve([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])

# ----
load_vectors_length = Slider(0.1, range=0..1)
principal_stress_vectors_length = Slider(0.1, range=0..1)
stress_min_size = Slider(0.02, range=0..1)
stress_max_size = Slider(0.12, range=0..1)
diagrams_spacing = Slider(2, range=1..2)

demesh = DeconstructMesh(Mesh=mesh_2)  # -> Vertices, Faces, Colours, Normals
facen = FaceNormals(Mesh=mesh_2)  # -> Centers, Normals
mesh_3 = Mesh(brep)
mesh_4 = Mesh(brep_2)

# ---- group: bounding box for diagram spacing
bbox = BoundingBox(Content=[mesh, mesh_3, mesh_4], Plane=PlaneXY(0, 0, 0), UnionBox=True)  # -> Box, Box_2
boxprop = BoxProperties(Box=bbox.Box)  # -> Center, Diagonal, Area, Volume, Degeneracy
devec = DeconstructVector(Vector=boxprop.Diagonal)  # -> XComponent, YComponent, ZComponent
multiplication = Multiplication(A=devec.XComponent, B=diagrams_spacing)
X = UnitX(Factor=multiplication)

# ---- group: re-colored mesh
argb = SplitARGB(Colour=demesh.Colours)  # -> Alpha, Red, Green, Blue
merge = Merge(Data1=ColourSwatch(SwatchColor=RGB(255, 255, 255)), Data2=ColourSwatch(SwatchColor=RGB(255, 0, 0)))
interp = InterpolateData(Data=merge, Parameter=argb.Red, Interpolation=2)
# diagram 2
conmesh = ConstructMesh(Vertices=demesh.Vertices, Faces=demesh.Faces, Colours=interp)

# ---- group: stress scalar field
num_2 = Number(num)
bnd = Bounds(Numbers=flatten(num_2))
dom = ConstructDomain(DomainStart=stress_min_size, DomainEnd=stress_max_size)
remap = RemapNumbers(Value=num_2, Source=bnd, Target=dom)  # -> Mapped, Clipped
msphere = MeshSphere(Base=facen.Centers, Radius=remap.Mapped, UCount="10", VCount="10")

# ----
multiplication_2 = Multiplication(A=X, B="2")
move = Move(Geometry=mesh, Motion=multiplication_2)  # -> Geometry, Transform
medges = MeshEdges(Mesh=move.Geometry)  # -> NakedEdges, InteriorEdges, NonManifoldEdges
# diagram 3
crv_3 = Curve([medges.NakedEdges, medges.InteriorEdges])
move_2 = Move(Geometry=msphere, Motion=multiplication_2)  # -> Geometry, Transform

# ---- group: loads
edges = BrepEdges(Brep=brep)  # -> Naked, Interior, NonManifold
mmx = MeshMesh(MeshA=mesh_2, MeshB=mesh_3, UseMeshMeshFast=True)
minc = MeshInclusion(Mesh=mesh_3, Point=demesh.Vertices, Strict=False)
cull = CullPattern(List=demesh.Vertices, CullPattern=minc)
line = LineSDL(Start=cull, Direction=Vector(0, 0, 1), Length=load_vectors_length)

# ---- group: supports
minc_2 = MeshInclusion(Mesh=mesh_4, Point=demesh.Vertices, Strict=False)
edges_2 = BrepEdges(Brep=brep_2)  # -> Naked, Interior, NonManifold
mmx_2 = MeshMesh(MeshA=mesh_2, MeshB=mesh_4, UseMeshMeshFast=True)
cull_2 = CullPattern(List=demesh.Vertices, CullPattern=minc_2)

# ----
# Millipede graph generator
# 
# generate Millipede diagrams
# 
# code by Alessio Erioli
# 
# v 1.0
# 
# © Co-de-iT 2018 _ Creative Commons Attribution-NonCommercial-ShareAlike 4.0 International License
medges_2 = MeshEdges(Mesh=mesh)  # -> NakedEdges, InteriorEdges, NonManifoldEdges
# diagram 1
crv_4 = Curve([medges_2.NakedEdges, medges_2.InteriorEdges])

# ---- group: principal stress directions
line_2 = LineSDL(Start=facen.Centers, Direction=crv, Length=principal_stress_vectors_length)
line_3 = LineSDL(Start=facen.Centers, Direction=crv_2, Length=principal_stress_vectors_length)

# ----
move_3 = Move(Geometry=line_2, Motion=X)  # -> Geometry, Transform
move_4 = Move(Geometry=line_3, Motion=X)  # -> Geometry, Transform
move_5 = Move(Geometry=conmesh, Motion=X)  # -> Geometry, Transform

panel = Panel("""base mesh
base wires
loads
supports
col mesh
PS1 dir
PS2 dir
wire mesh
stress spheres""")
ghost_wires = ColourSwatch(SwatchColor=RGB(140, 140, 140))
unmod_wires = ColourSwatch(SwatchColor=RGB(105, 105, 105))
swatch = ColourSwatch(SwatchColor=RGB(0, 0, 0))
material = CreateMaterial(
    Diffuse=ColourSwatch(SwatchColor=RGB(0, 0, 0)),
    Specular=RGB(255, 255, 255),
    Emission=RGB(0, 0, 0),
    Transparency=0,
    Shine=0)
entwine = Entwine(
    Branch01=unmod_wires,
    Branch02=ColourSwatch(SwatchColor=RGB(200, 0, 0)),
    Branch03=ColourSwatch(SwatchColor=RGB(0, 0, 255)),
    Branch05=swatch,
    Branch06=swatch,
    Branch07=ghost_wires,
    FlattenInputs=True)
concat = Concatenate(FragmentA="MP_Graph", FragmentB=panel)  # -> graft(Result)
entwine_2 = Entwine(
    Branch00=mesh,
    Branch01=crv_4,
    Branch02=[line, edges.Interior, mmx],
    Branch03=[edges_2.Interior, cull_2, mmx_2],
    Branch04=move_5.Geometry,
    Branch05=move_3.Geometry,
    Branch06=move_4.Geometry,
    Branch07=crv_3,
    Branch08=move_2.Geometry,
    FlattenInputs=True)
entwine_3 = Entwine(Branch08=material, FlattenInputs=True)

# ---- group: enable for spheres preview
preview = CustomPreview(Geometry=move_2.Geometry, Material=material)  # disabled

# ----
group = BooleanToggle(False)
bake = Button()
f_bakeatt = BakeAttributesEnhanced(obj=entwine_2, layer=concat, color=entwine, material=entwine_3, group=group, bake_iT=bake)  # -> info; inputs obj: GeometryBase, name: String, layer: String, color: Color, pWidth: Double, wires: Int32, group_n: Int32, group: Boolean, bake_iT: Boolean
#   port layer: Layer name for the object if the layer doesn't exist, it will be created
#   port bake_iT: Performs bake operation attach a button here and click to bake
# ---------- f_bakeatt: C# ----------
                                                                /*
    froGH - a sparse collection of (in)utilities for Grasshopper

    Bake Attributes ++
    Original Version Written by Giulio Piacentino - 2010 11 21 - for Grasshopper 0.8.002
    Enhanced by Co-de-iT (Alessio) - now bakes on chosen layer(s) and in groups

    froGH by Co-de-iT is licensed under a Creative Commons Attribution 4.0 International License.
    http://creativecommons.org/licenses/by/4.0/

    */

    initComp();

    if (bake_iT)
    {
      if(obj == null)
      {
        Print("No object to bake");
        return;
      }

      //Make new attribute to set name
      Rhino.DocObjects.ObjectAttributes att = new Rhino.DocObjects.ObjectAttributes();

      //Set object name
      if(!string.IsNullOrEmpty(name))
      {
        att.Name = name;
      }

      //Set color
      if(!color.IsEmpty)
      {
        att.ColorSource = Rhino.DocObjects.ObjectColorSource.ColorFromObject; //Make the color type "by object"
        att.ObjectColor = color;

        att.PlotColorSource = Rhino.DocObjects.ObjectPlotColorSource.PlotColorFromObject; //Make the plot color type "by object"
        att.PlotColor = color;
      }

      // Set group

      if(group)
      {
        doc.Groups.Add(Convert.ToString(group_n));
        att.AddToGroup(group_n);

      }

      //Set layer
      if(!string.IsNullOrEmpty(layer) && Rhino.DocObjects.Layer.IsValidName(layer))
      {
        //Get the current layer index
        Rhino.DocObjects.Tables.LayerTable layerTable = doc.Layers;
        int layerIndex = layerTable.Find(layer, true);

        if(layerIndex < 0) //This layer does not exist, we add it
        {
          Rhino.DocObjects.Layer onlayer = new Rhino.DocObjects.Layer(); //Make a new layer
          onlayer.Name = layer;

          layerIndex = layerTable.Add(onlayer); //Add the layer to the layer table
          if (layerIndex > -1) //We manged to add layer!
          {
            att.LayerIndex = layerIndex;
            Print("Added new layer to the document at position " + layerIndex + " named " + layer + ". ");
          } else
            Print("Layer did not add. Try cleaning up your layers."); //This never happened to me.
        }
        else
          att.LayerIndex = layerIndex; //We simply add to the existing layer
      }


      //Set plotweight
      if(pWidth > 0)
      {
        att.PlotWeightSource = Rhino.DocObjects.ObjectPlotWeightSource.PlotWeightFromObject;
        att.PlotWeight = pWidth;
      }


      //Set material
      bool materialByName = !string.IsNullOrEmpty(material as string);
      Rhino.Display.DisplayMaterial inMaterial = material as Rhino.Display.DisplayMaterial;
      if(material is Color)
      {
        inMaterial = new Rhino.Display.DisplayMaterial((Color) material);
      }
      if(material != null && inMaterial == null && !materialByName)
      {
        if(!(material is string))
        {
          try //We also resort to try with IConvertible
          {
            inMaterial = (Rhino.Display.DisplayMaterial) Convert.ChangeType(material, typeof(Rhino.Display.DisplayMaterial));
          }
          catch(InvalidCastException)
          {
          }
        }
      }
      if(inMaterial != null || materialByName)
      {
        string matName;

        if(!materialByName)
        {
          matName = string.Format("A:{0}-D:{1}-E:{2}-S:{3},{4}-T:{5}",
            Format(inMaterial.Ambient),
            Format(inMaterial.Diffuse),
            Format(inMaterial.Emission),
            Format(inMaterial.Specular),
            inMaterial.Shine.ToString(),
            inMaterial.Transparency.ToString()
            );
        }
        else
        {
          matName = (string) material;
        }

        int materialIndex = doc.Materials.Find(matName, true);
        if(materialIndex < 0 && !materialByName) //Material does not exist and we have its specs
        {
          materialIndex = doc.Materials.Add(); //Let's add it
          if(materialIndex > -1)
          {
            Print("Added new material at position " + materialIndex + " named \"" + matName + "\". ");
            Rhino.DocObjects.Material m = doc.Materials[materialIndex];
            m.Name = matName;
            m.AmbientColor = inMaterial.Ambient;
            m.DiffuseColor = inMaterial.Diffuse;
            m.EmissionColor = inMaterial.Emission;
            //m.ReflectionColor = no equivalent
            m.SpecularColor = inMaterial.Specular;
            m.Shine = inMaterial.Shine;
            m.Transparency = inMaterial.Transparency;
            //m.TransparentColor = no equivalent
            m.CommitChanges();

            att.MaterialSource = Rhino.DocObjects.ObjectMaterialSource.MaterialFromObject;
            att.MaterialIndex = materialIndex;
          }
          else
            Print("Material did not add. Try cleaning up your materials."); //This never happened to me.
        }
        else if(materialIndex < 0 && materialByName) //Material does not exist and we do not have its specs. We do nothing
        {
          Print("Warning: material name not found. I cannot set the source to this material name. Add a material with name: " + matName);
        }
        else
        {
          //If this material exists, we do not replace it!
          att.MaterialSource = Rhino.DocObjects.ObjectMaterialSource.MaterialFromObject;
          att.MaterialIndex = materialIndex;
        }
      }


      //Set wire density
      if(wires == -1 || wires > 0)
      {
        att.WireDensity = wires;
      }


      //Bake to the right type of object
      switch(obj.ObjectType)
      {
        case Rhino.DocObjects.ObjectType.Brep:
          doc.Objects.AddBrep(obj as Brep, att);
          break;
        case Rhino.DocObjects.ObjectType.Curve:
          doc.Objects.AddCurve(obj as Curve, att);
          break;
        case Rhino.DocObjects.ObjectType.Point:
          doc.Objects.AddPoint((obj as Rhino.Geometry.Point).Location, att);
          break;
        case Rhino.DocObjects.ObjectType.Surface:
          doc.Objects.AddSurface(obj as Surface, att);
          break;
        case Rhino.DocObjects.ObjectType.Mesh:
          doc.Objects.AddMesh(obj as Mesh, att);
          break;
        case Rhino.DocObjects.ObjectType.Extrusion:
          typeof(Rhino.DocObjects.Tables.ObjectTable).InvokeMember("AddExtrusion", BindingFlags.Instance | BindingFlags.InvokeMethod, null, doc.Objects, new object[]{obj, att});
          break;
        case Rhino.DocObjects.ObjectType.PointSet:
          doc.Objects.AddPointCloud(obj as Rhino.Geometry.PointCloud, att); //This is a speculative entry
          break;
        default:
          Print("The script does not know how to handle this type of geometry: " + obj.GetType().FullName);
          break;
      }
      Print("Added " + obj.GetType().Name);

    }
    else
    {
      Print("Inactive");
    }
    //obj_out = obj;
# ---------- f_bakeatt: C# additional code ----------
  void initComp(){

    Component.Name = "Bake Attributes Enhanced";
    Component.NickName = "f_BakeAtt++";
    Component.Description = "Bakes objects with attributes such as color, material, layer, object name, wire density. Option to bake in groups";
    Component.Params.Input[0].Name = "Object";
    Component.Params.Input[0].Description = "Object to bake";
    Component.Params.Input[1].Name = "Object name";
    Component.Params.Input[1].Description = "A custom name for the object";
    Component.Params.Input[2].Name = "Object Layer";
    Component.Params.Input[2].Description = "Layer name for the object\nif the layer doesn't exist, it will be created";
    Component.Params.Input[3].Name = "Object Color";
    Component.Params.Input[3].Description = "Color of baked object";
    Component.Params.Input[4].Name = "Print Width";
    Component.Params.Input[4].Description = "Print width";
    Component.Params.Input[5].Name = "Wire density";
    Component.Params.Input[5].Description = "Density of wires for display";
    Component.Params.Input[6].Name = "Material";
    Component.Params.Input[6].Description = "Object custom material";
    Component.Params.Input[7].Name = "Group Number";
    Component.Params.Input[7].Description = "Number of the group for the object\n(in case group option is active)";
    Component.Params.Input[8].Name = "Group Objects";
    Component.Params.Input[8].Description = "Bake objects in groups according to the group number for each object";
    Component.Params.Input[9].Name = "Bake it!";
    Component.Params.Input[9].Description = "Performs bake operation\nattach a button here and click to bake";
    Component.Params.Output[0].Name = "Info";
    Component.Params.Output[0].Description = "Info on the bake process/result";

  }

  static string Format(Color c)
  {
    return (new System.Text.StringBuilder("A")).Append(c.A.ToString()).Append("R").Append(c.R.ToString()).Append("G")
      .Append(c.G.ToString()).Append("B").Append(c.B.ToString()).ToString();
  }
# ---------- end f_bakeatt ----------
