# Grasshopper definition heatmap.gh (Grasshopper 1.0.5)
# Copyright: Co-de-iT
# plug-ins: Kangaroo2 Components

mesh = Mesh(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)
demesh = DeconstructMesh(Mesh=mesh)  # -> Vertices, Faces, Colours, Normals
nv = NakedVertices(Mesh=mesh)  # -> ClothedIndex, NakedIndex, ClothedPts, NakedPts

# ---- group: Z-values
pdecon = Deconstruct(Point=demesh.Vertices)  # -> XComponent, YComponent, ZComponent

# ---- group: distance from naked vertices
cp = ClosestPoint(Point=demesh.Vertices, Cloud=nv.NakedPts)  # -> ClosestPoint, CPIndex, Distance

# ---- group: data for heatmap
num = Number(pdecon.ZComponent)

# ----
bnd = Bounds(Numbers=flatten(num))
dom = ConstructDomain(DomainStart=0, DomainEnd=1)
# <title>
# 
# <description>
# 
# code by <author>
# 
# v <version>
# 
# © Co-de-iT 2018 _ Creative Commons Attribution-NonCommercial-ShareAlike 4.0 International License
remap = RemapNumbers(Value=num, Source=bnd, Target=dom)  # -> Mapped, Clipped

# ---- group: modulation
graph = GraphMapper(
    remap.Mapped,
    x0=0,
    x1=1,
    y0=0,
    y1=1,
    container_name="Bezier",
    cpx=[0, 0.4583333433, 0.7355072498, 1],
    cpy=[0, 0.01014488935, 1, 1])

# ----
merge = Merge(Data1=ColourSwatch(SwatchColor=RGB(255, 255, 255)), Data2=ColourSwatch(SwatchColor=RGB(200, 0, 0)))
interp = InterpolateData(Data=merge, Parameter=graph, Interpolation=2)
conmesh = ConstructMesh(Vertices=demesh.Vertices, Faces=demesh.Faces, Colours=interp)
